# Grasshopper definition dia 2- listas - topografia-arbol.gh (Grasshopper 1.0.7)
# Copyright: N.FC.M
# plug-ins: Bifocals

# Nacho Monereo.
# nachomonereo@gmail.com
# CLASE
# - LISTAS -
make_nacho = Makenacho()  # disabled
# SESION  - 2 -
# GRASHOPPER BASICO {1}
nacho = NACHO()
number_slider = Slider(3, range=0..10)  # disabled
number_slider_2 = Slider(18, range=0..100)  # disabled
number_slider_3 = Slider(4, range=0..10)  # disabled
number_slider_4 = Slider(80, range=0..100)  # disabled

number_slider_5 = Slider(8, range=0..10)  # disabled
number_slider_6 = Slider(0.9, range=0..10)  # disabled
cir = Circle(Plane=PlaneXY(0, 0, 0), Radius=1)  # disabled
series = Series(Start=0, Step=number_slider_6, Count=number_slider_5)  # disabled
Z = UnitZ(Factor=series)  # disabled
number_slider_7 = Slider(6, range=0..10)  # disabled
panel = Panel("-0.5 to 0.5")  # disabled
move = Move(Geometry=cir, Motion=Z)  # -> Geometry, Transform; disabled
random = Random(Range=panel, Number=number_slider_5, Seed=number_slider_7)  # disabled
jitter = Jitter(List=random, Jitter=1, Seed=2)  # -> Values, Indices; disabled
vec = VectorXYZ(XComponent=random, YComponent=jitter.Values, ZComponent=0)  # -> Vector, Length; disabled
move_2 = Move(Geometry=move.Geometry, Motion=vec.Vector)  # -> Geometry, Transform; disabled
panel_2 = Panel("0.6 to 1.2")  # disabled
area = Area(Geometry=move_2.Geometry)  # -> Area, Centroid; disabled
random_2 = Random(Range=panel_2, Number=number_slider_5, Seed=number_slider_7)  # disabled
scale = Scale(Geometry=move_2.Geometry, Center=area.Centroid, Factor=random_2)  # -> Geometry, Transform; disabled
number_slider_8 = Slider(9, range=0..100)  # disabled
lng = ListLength(List=scale.Geometry)  # disabled
lng_2 = ListLength(List=scale.Geometry)  # disabled
panel_3 = Panel("-1")  # disabled
series_2 = Series(Start=0, Step=1, Count=lng)  # -> graft(Series); disabled
series_3 = Series(Start=0, Step=panel_3, Count=lng_2)  # -> graft(Series); disabled
divide = DivideCurve(Curve=scale.Geometry, Count=number_slider_8, Kinks=False)  # -> Points, Tangents, Parameters; disabled
shift = ShiftList(List=divide.Points, Shift=series_2, Wrap=True)  # disabled
shift_2 = ShiftList(List=divide.Points, Shift=series_3, Wrap=True)  # disabled
flip = FlipMatrix(Data=shift)  # disabled
flip_2 = FlipMatrix(Data=shift_2)  # disabled
pline = PolyLine(Vertices=flip_2, Closed=False)  # disabled
pline_2 = PolyLine(Vertices=flip, Closed=False)  # disabled
crv = Curve(flatten([scale.Geometry, pline_2, pline]))  # disabled
number_slider_9 = Slider(0.04, range=0..0.1)  # disabled
pipe = Pipe(Curve=crv, Radius=number_slider_9, Caps=0)  # disabled

crv_2 = Curve(<curve referenced from the Rhino model>)  # disabled
crv_3 = Curve(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)  # disabled
number_slider_10 = Slider(301, range=0..1000)  # disabled
rdiff = RegionDifference(CurvesA=crv_3, CurvesB=crv_2)  # disabled
boundary = BoundarySurfaces(Edges=rdiff)  # disabled
popgeo = PopulateGeometry(Geometry=boundary, Count=number_slider_10, Seed=1)  # disabled
number_slider_11 = Slider(5, range=0..10)  # disabled
pull = PullPoint(Point=popgeo, Geometry=[crv_3, crv_2], ClosestOnly=True)  # -> ClosestPoint, Distance; disabled
crv_4 = Curve(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)  # disabled
division = Division(A=pull.Distance, B=number_slider_11)  # disabled
ln = Line(StartPoint=popgeo, EndPoint=pull.ClosestPoint)  # disabled
area_2 = Area(Geometry=crv_4)  # -> Area, Centroid; disabled
amp = Amplitude(Vector=ln, Amplitude=division)  # disabled
move_3 = Move(Geometry=popgeo, Motion=amp)  # -> Geometry, Transform; disabled
ln_2 = Line(StartPoint=area_2.Centroid, EndPoint=move_3.Geometry)  # disabled
move_4 = Move(Geometry=crv_4, Motion=ln_2)  # -> Geometry, Transform; disabled
cir_2 = Circle(Plane=move_3.Geometry, Radius=1)  # disabled

md_slider = MDSlider(
    SliderMode=0,
    slider_value=Point(0.7646119653, 0.6845236614, 0.5),
    x_domain=Domain(0, 1),
    y_domain=Domain(0, 1),
    z_domain=Domain(0, 1))  # disabled
sqgrid = Square(Plane=PlaneXY(0, 0, 0), Size=number_slider, ExtentX=number_slider_2, ExtentY=number_slider_2)  # -> flatten(Cells), Points; disabled
multiplication = Multiplication(A=number_slider, B=number_slider_2)  # disabled
sqgrid_2 = Square(Plane=PlaneXY(0, 0, 0), Size=number_slider_3, ExtentX=number_slider_4, ExtentY=number_slider_4)  # -> flatten(Cells), Points; disabled
multiplication_2 = Multiplication(A=multiplication, B=md_slider)  # disabled
area_3 = Area(Geometry=sqgrid.Cells)  # -> Area, Centroid; disabled

split = SplitTree()  # -> Positive, Negative; disabled
entwine = Entwine(FlattenInputs=True)  # disabled
merge = Merge()  # disabled
tstat = TreeStatistics()  # -> Paths, Length, Count; disabled
trim = TrimTree(Depth=1)  # disabled
flatten = FlattenTree(Path="{0}")  # disabled
path_mapper = PathMapper()  # disabled
prune = PruneTree(Minimum=0, Maximum=0)  # disabled
flip_3 = FlipMatrix()  # disabled
match = MatchTree()  # disabled
graft = GraftTree(IncludeEmptyLists=True, IncludeNullItems=True)  # disabled
bang = ExplodeTree()  # -> Branch0, Branch1; disabled
compare = PathCompare(Mask="*")  # disabled
item = TreeItem(Index=0, Wrap=True)  # disabled
branch = TreeBranch(MaintainPaths=True)  # disabled
path = ConstructPath()  # disabled

number_slider_12 = Slider(0.6, range=0..1)  # disabled

number_slider_13 = Slider(1, range=0..1)  # disabled
pt = Point([Point(47.58175456, 35.23681734, 0), Point(47.58175456, 29.19788767, 0), Point(47.58175456, 22.35376739, 0), Point(47.58175456, 15.77804398, 0)])  # disabled
pt_2 = Point([Point(64.89335293, 29.19788767, 0), Point(64.89335293, 22.35376739, 0), Point(64.89335293, 15.77804398, 0)])  # disabled
long = LongestList(ListA=pt, ListB=pt_2, PaddingMode=2)  # -> ListA, ListB; disabled
points = PointList(Points=pt, Size=number_slider_13)  # disabled
points_2 = PointList(Points=pt_2, Size=number_slider_13)  # disabled
ln_3 = Line(StartPoint=long.ListA, EndPoint=long.ListB)  # disabled

number_slider_14 = Slider(1, range=0..1)  # disabled
pt_3 = Point([Point(47.58175456, 35.23681734, 0), Point(47.58175456, 29.19788767, 0), Point(47.58175456, 22.35376739, 0), Point(47.58175456, 15.77804398, 0)])  # disabled
pt_4 = Point([Point(64.89335293, 29.19788767, 0), Point(64.89335293, 22.35376739, 0), Point(64.89335293, 15.77804398, 0)])  # disabled
short = ShortestList(ListA=pt_3, ListB=pt_4, TrimMode=2)  # -> ListA, ListB; disabled
points_3 = PointList(Points=pt_3, Size=number_slider_14)  # disabled
points_4 = PointList(Points=pt_4, Size=number_slider_14)  # disabled
ln_4 = Line(StartPoint=short.ListA, EndPoint=short.ListB)  # disabled

area_4 = Area(Geometry=sqgrid_2.Cells)  # -> Area, Centroid; disabled
multiplication_3 = Multiplication(A=number_slider_4, B=number_slider_3)  # disabled

pt_5 = Point([Point(47.58175456, 35.23681734, 0), Point(47.58175456, 29.19788767, 0), Point(47.58175456, 22.35376739, 0), Point(47.58175456, 15.77804398, 0)])  # disabled
pt_6 = Point([Point(64.89335293, 29.19788767, 0), Point(64.89335293, 22.35376739, 0), Point(64.89335293, 15.77804398, 0)])  # disabled
number_slider_15 = Slider(1, range=0..1)  # disabled
panel_4 = Panel(pt_5)  # disabled
panel_5 = Panel(pt_6)  # disabled
points_5 = PointList(Points=pt_6, Size=number_slider_15)  # disabled
points_6 = PointList(Points=pt_5, Size=number_slider_15)  # disabled
ln_5 = Line(StartPoint=pt_5, EndPoint=pt_6)  # disabled

number_slider_16 = Slider(0.9, range=0..1)  # disabled
ln_6 = Line(StartPoint=area_3.Centroid, EndPoint=multiplication_2)  # disabled
division_2 = Division(A=area_4.Centroid, B=multiplication_3)  # disabled
len = Length(Curve=ln_6)  # disabled
bnd = Bounds(Numbers=len)  # disabled

number_slider_17 = Slider(2, range=0..10)  # disabled
crv_5 = Curve(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)  # disabled
number_slider_18 = Slider(4, range=0..10)  # disabled
divide_2 = DivideCurve(Curve=crv_5, Count=number_slider_17, Kinks=False)  # -> Points, Tangents, Parameters; disabled
number_slider_19 = Slider(2, range=0..10)  # disabled
panel_6 = Panel(divide_2.Points)  # disabled
panel_7 = Panel(crv_5)  # disabled
cir_3 = Circle(Plane=divide_2.Points, Radius=number_slider_18)  # disabled
divide_3 = DivideCurve(Curve=cir_3, Count=number_slider_19, Kinks=False)  # -> Points, Tangents, Parameters; disabled
panel_8 = Panel(divide_3.Points)  # disabled

dom = ConstructDomain(DomainStart=expr("x/2", number_slider), DomainEnd=expr("x/2", number_slider_12))  # disabled
dom_2 = ConstructDomain(DomainStart=number_slider_16, DomainEnd=expr("x/2", number_slider_3))  # disabled
image = ImageSampler(division_2, Filter="Colour", Interpolate=False, Umax=1, Umin=0, Vmax=1, Vmin=0, Wrap=1)  # disabled
image_2 = ImageSampler(division_2, Filter="Red", Interpolate=False, Umax=1, Umin=0, Vmax=1, Vmin=0, Wrap=1)  # disabled
remap = RemapNumbers(Value=len, Source=bnd, Target=dom)  # -> Mapped, Clipped; disabled
dedomain = DeconstructDomain(Domain=dom)  # -> Start, End; disabled
remap_2 = RemapNumbers(Value=image_2, Source=Domain(0, 1), Target=dom_2)  # -> Mapped, Clipped; disabled
cir_4 = Circle(Plane=area_3.Centroid, Radius=remap.Mapped)  # disabled
cir_5 = Circle(Plane=area_4.Centroid, Radius=remap_2.Mapped)  # disabled
panel_9 = Panel("listas")  # disabled
gradient = Gradient(
    LowerLimit=dedomain.Start,
    UpperLimit=dedomain.End,
    Parameter=remap.Mapped,
    stops=[0: RGB(245, 132, 200), 1: RGB(0, 255, 187)])  # disabled

number_slider_20 = Slider(1, range=0..1)  # disabled
pt_7 = Point([Point(47.58175456, 35.23681734, 0), Point(47.58175456, 29.19788767, 0), Point(47.58175456, 22.35376739, 0), Point(47.58175456, 15.77804398, 0)])  # disabled
panel_10 = Panel(pt_7)  # disabled
pt_8 = Point(graft([Point(64.89335293, 29.19788767, 0), Point(64.89335293, 22.35376739, 0), Point(64.89335293, 15.77804398, 0)]))  # disabled
panel_11 = Panel(pt_8)  # disabled
ln_7 = Line(StartPoint=pt_7, EndPoint=pt_8)  # -> flatten(Line); disabled
points_7 = PointList(Points=pt_7, Size=number_slider_20)  # disabled
points_8 = PointList(Points=pt_8, Size=number_slider_20)  # disabled
panel_12 = Panel(ln_7)  # disabled

preview = CustomPreview(Geometry=cir_5, Material=image)  # disabled

ins = InsertItems(Wrap=True)  # disabled
replace = ReplaceItems(Wrap=False)  # disabled
shift_3 = ShiftList(Shift=1, Wrap=True)  # disabled
subset = SubList(Wrap=True)  # -> List, Index; disabled
crossref = CrossReference(CrossMode=1)  # -> ListA, ListB; disabled
dispatch = Dispatch(DispatchPattern=[True, False])  # -> ListA, ListB; disabled
p_n_c = PickNChoose(Pattern=[0, 1])  # disabled
combine = CombineData()  # -> Result, Index; disabled
lng_3 = ListLength()  # disabled
sort = SortList()  # -> Keys, ValuesA; disabled
nullrep = ReplaceNulls()  # -> Items, Count; disabled
item_2 = ListItem(Index=0, Wrap=True)  # disabled
split_2 = SplitList()  # -> ListA, ListB; disabled
sift = SiftPattern(SiftPattern=[0, 0, 1, 1])  # -> Output0, Output1; disabled
rev = ReverseList()  # disabled
null = NullItem()  # -> NullFlags, InvalidFlags, Description; disabled
index = ItemIndex()  # disabled

preview_2 = CustomPreview(Geometry=cir_4, Material=gradient)  # disabled

number_slider_21 = Slider(1, range=0..1)  # disabled
pt_9 = Point(graft([Point(64.89335293, 29.19788767, 0), Point(64.89335293, 22.35376739, 0), Point(64.89335293, 15.77804398, 0)]))  # disabled
pt_10 = Point(graft([Point(47.58175456, 35.23681734, 0), Point(47.58175456, 29.19788767, 0), Point(47.58175456, 22.35376739, 0), Point(47.58175456, 15.77804398, 0)]))  # disabled
panel_13 = Panel(pt_10)  # disabled
panel_14 = Panel(pt_9)  # disabled
ln_8 = Line(StartPoint=pt_10, EndPoint=pt_9)  # -> flatten(Line); disabled
points_9 = PointList(Points=pt_10, Size=number_slider_21)  # disabled
points_10 = PointList(Points=pt_9, Size=number_slider_21)  # disabled

number_slider_22 = Slider(4, range=0..10)  # disabled
number_slider_23 = Slider(3, range=0..10)  # disabled
panel_15 = Panel("866")  # disabled
panel_16 = Panel("1920")  # disabled
crv_6 = Curve(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)  # disabled
pln = Plane(Plane(origin=(832.1274287, 1153.895576, 0), x=(0.7378338596, 0.6749823669, 0), y=(-0.6749823669, 0.7378338596, 0)))  # disabled
number_slider_24 = Slider(3, range=0..10)  # disabled
panel_17 = Panel(crv_6)  # disabled
division_3 = Division(A=panel_16, B=number_slider_22)  # disabled
division_4 = Division(A=panel_15, B=number_slider_22)  # disabled

# ---- group: listas puntos
pt_11 = Point(graft([Point(9.948981714, 9.142123242, 0), Point(10.15307313, 6.395707879, 0), Point(9.948981714, 3.850864286, 0), Point(9.948981714, 1.303221085, 0)]))  # disabled
pt_12 = Point([Point(16.80524109, 6.064085541, 0), Point(16.72403286, 3.878860365, 0), Point(16.72403286, 1.023260293, 0)])  # disabled
panel_18 = Panel("1")  # disabled
panel_19 = Panel("1")  # disabled
points_11 = PointList(Points=pt_11, Size=panel_19)  # disabled
short_2 = ShortestList(ListA=pt_11, ListB=pt_12, TrimMode=2)  # -> ListA, ListB; disabled
points_12 = PointList(Points=pt_12, Size=panel_18)  # disabled
ln_9 = Line(StartPoint=short_2.ListA, EndPoint=short_2.ListB)  # disabled

# ----
divide_4 = DivideCurve(Curve=crv_6, Count=number_slider_23, Kinks=False)  # -> Points, Tangents, Parameters; disabled
number_slider_25 = Slider(5, range=0..10)  # disabled
pt_13 = Point([Point(9.948981714, 9.142123242, 0), Point(9.948981714, 6.62247612, 0), Point(9.948981714, 3.850864286, 0), Point(9.948981714, 1.303221085, 0)])  # disabled
pt_14 = Point([Point(16.72403286, 6.538487882, 0), Point(16.72403286, 3.878860365, 0), Point(16.72403286, 1.023260293, 0)])  # disabled
rectangle = Rectangle(Plane=pln, XSize=division_3, YSize=division_4, Radius=0)  # -> Rectangle, Length; disabled
panel_20 = Panel(divide_4.Points)  # disabled
number_slider_26 = Slider(6, range=0..100)  # disabled
cir_6 = Circle(Plane=divide_4.Points, Radius=number_slider_24)  # disabled
panel_21 = Panel("1")  # disabled
panel_22 = Panel("1")  # disabled

# ---- group: listas puntos
long_2 = LongestList(ListA=pt_11, ListB=pt_12, PaddingMode=2)  # -> ListA, ListB; disabled
ln_10 = Line(StartPoint=long_2.ListA, EndPoint=long_2.ListB)  # disabled

# ----
srf = Surface(rectangle.Rectangle)  # disabled
points_13 = PointList(Points=pt_13, Size=panel_22)  # disabled
points_14 = PointList(Points=pt_14, Size=panel_21)  # disabled
dim = Dimensions(Surface=srf)  # -> UDimension, VDimension; disabled
panel_23 = Panel(cir_6)  # disabled
divide_5 = DivideCurve(Curve=cir_6, Count=number_slider_25, Kinks=False)  # -> simplify(Points), Tangents, Parameters; disabled
ln_11 = Line(StartPoint=pt_13, EndPoint=pt_14)  # disabled
number_slider_27 = Slider(1, range=0..10)  # disabled
division_5 = Division(A=dim.UDimension, B=number_slider_26)  # disabled
division_6 = Division(A=dim.VDimension, B=number_slider_26)  # disabled
panel_24 = Panel(ln_10)  # disabled
panel_25 = Panel(ln_9)  # disabled
panel_26 = Panel("{1}")  # disabled
panel_27 = Panel("1")  # disabled
sdivide = DivideSurface(Surface=reparameterize(srf), UCount=division_5, VCount=division_6)  # -> Points, Normals, Parameters; disabled
branch_2 = TreeBranch(Tree=divide_5.Points, Path=panel_26, MaintainPaths=True)  # disabled
item_3 = ListItem(List=divide_5.Points, Index=number_slider_27, Wrap=True)  # disabled
panel_28 = Panel("0 to 100")  # disabled
image_3 = ImageSampler(
    sdivide.Parameters,
    FilePath="C:\Users\User\Desktop\heightmapper-1633691157429.png",
    Filter="Value",
    Interpolate=False,
    Umax=1,
    Umin=0,
    Vmax=1,
    Vmin=0,
    Wrap=1)  # disabled
panel_29 = Panel(item_3)  # disabled
panel_30 = Panel(branch_2)  # disabled
remap_3 = RemapNumbers(Value=image_3, Source=Domain(0, 1), Target=panel_28)  # -> Mapped, Clipped; disabled
Z_2 = UnitZ(Factor=remap_3.Mapped)  # disabled
move_5 = Move(Geometry=sdivide.Points, Motion=Z_2)  # -> flatten(Geometry), Transform; disabled
panel_31 = Panel("1")  # disabled
addition = Addition(A=division_5, B=panel_31)  # disabled
number_slider_28 = Slider(460, range=0..1000)  # disabled
srfgrid = SurfaceFromPoints(Points=move_5.Geometry, UCount=addition, Interpolate=False)  # disabled
number_slider_29 = Slider(5, range=0..10)  # disabled
popgeo_2 = PopulateGeometry(Geometry=srfgrid, Count=number_slider_28, Seed=1)  # disabled
brep_cp = BrepClosestPoint(Point=popgeo_2, Brep=srfgrid)  # -> Point, Normal, Distance; disabled
Z_3 = UnitZ(Factor=1)  # disabled
number_slider_30 = Slider(49, range=0..100)  # disabled
contour = Contour(Shape=srfgrid, Point=Point(0, 0, 0), Direction=Vector(0, 0, 1), Distance=number_slider_29)  # disabled
angle = Angle(VectorA=brep_cp.Normal, VectorB=Z_3)  # -> Angle, Reflex; disabled
deg = Degrees(Radians=angle.Angle)  # disabled
larger = LargerThan(FirstNumber=deg, SecondNumber=number_slider_30)  # -> LargerThan, OrEqualTo; disabled
cull = CullPattern(List=popgeo_2, CullPattern=invert(larger.LargerThan))  # disabled

# ---- group: punto de arbol
pt_15 = Point(Point(193.7059289, -43.91750518, -1.570785508))  # disabled

# ----
vec2pt = Vector2Pt(PointA=pt_15, PointB=cull, Unitize=False)  # -> Vector, Length; disabled

# ---- group: arbol
mesh = Mesh(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)  # disabled

# ----
lng_4 = ListLength(List=cull)  # disabled
lng_5 = ListLength(List=cull)  # disabled
panel_32 = Panel("2 to 7")  # disabled
panel_33 = Panel("0 to 180")  # disabled
move_6 = Move(Geometry=mesh, Motion=vec2pt.Vector)  # -> Geometry, Transform; disabled
random_3 = Random(Range=panel_32, Number=lng_4, Seed=2)  # disabled
random_4 = Random(Range=panel_33, Number=lng_5, Seed=2)  # disabled
scale_2 = Scale(Geometry=move_6.Geometry, Center=cull, Factor=random_3)  # -> Geometry, Transform; disabled
rotate = Rotate(Geometry=scale_2.Geometry, Angle=degrees(random_4), Plane=cull)  # -> Geometry, Transform; disabled
number_slider_31 = Slider(1.3, range=0..10)  # disabled
number_slider_32 = Slider(10, range=0..10)  # disabled
pt_16 = Point(Point(0, -0.1169582594, 0))  # disabled
number_slider_33 = Slider(6, range=0..100)  # disabled
panel_34 = Panel("937")  # disabled
panel_35 = Panel("1920")  # disabled
series_4 = Series(Start=0, Step=number_slider_31, Count=number_slider_32)  # disabled
md_slider_2 = MDSlider(
    SliderMode=0,
    slider_value=Point(0.4471524867, 0.3622719369, 0.5),
    x_domain=Domain(0, 1),
    y_domain=Domain(0, 1),
    z_domain=Domain(0, 1))  # disabled
rec = Rectangle({Plane=PlaneXY(35.7123231, 7.716029009, 0), Size=Domain2(u=-8.627722967..8.627722967, v=-8.627722967..8.627722967)})  # disabled
md_slider_3 = MDSlider(
    SliderMode=0,
    slider_value=Point(0.4471524867, 0.3622719369, 0.5),
    x_domain=Domain(0, 1),
    y_domain=Domain(0, 1),
    z_domain=Domain(0, 1))  # disabled
rec_2 = Rectangle({Plane=PlaneXY(35.7123231, 7.716029009, 0), Size=Domain2(u=-8.627722967..8.627722967, v=-8.627722967..8.627722967)})  # disabled
rec_3 = Rectangle({Plane=PlaneXY(35.7123231, 7.716029009, 0), Size=Domain2(u=-8.627722967..8.627722967, v=-8.627722967..8.627722967)})  # disabled
number_slider_34 = Slider(11, range=0..30)  # disabled
number_slider_35 = Slider(30, range=0..30)  # disabled
number_slider_36 = Slider(11, range=0..30)  # disabled
Z_4 = UnitZ(Factor=series_4)  # disabled
division_7 = Division(A=panel_35, B=number_slider_33)  # disabled
division_8 = Division(A=panel_34, B=number_slider_33)  # disabled
number_slider_37 = Slider(50, range=0..50)  # disabled
number_slider_38 = Slider(42, range=0..100)  # disabled
number_slider_39 = Slider(3, range=0..10)  # disabled
number_slider_40 = Slider(2, range=0..10)  # disabled
srf_2 = Surface(rec)  # disabled
srf_3 = Surface(rec_2)  # disabled
dim_2 = Dimensions(Surface=rec)  # -> UDimension, VDimension; disabled
dim_3 = Dimensions(Surface=rec_2)  # -> UDimension, VDimension; disabled
srf_4 = Surface(rec_3)  # disabled
dim_4 = Dimensions(Surface=rec_3)  # -> UDimension, VDimension; disabled
rectangle_2 = Rectangle(Plane=PlaneXY(0, 0, 0), XSize=division_7, YSize=division_8, Radius=0)  # -> Rectangle, Length; disabled
move_7 = Move(Geometry=pt_16, Motion=Z_4)  # -> Geometry, Transform; disabled
srf_5 = Surface(rectangle_2.Rectangle)  # disabled
pdecon = Deconstruct(Point=move_7.Geometry)  # -> XComponent, YComponent, ZComponent; disabled
evalsrf = EvaluateSurface(Surface=reparameterize(srf_2), Point=md_slider_2)  # -> Point, Normal, UDirection, VDirection, Frame; disabled
sdivide_2 = DivideSurface(Surface=srf_2, UCount=number_slider_34, VCount=number_slider_34)  # -> flatten(Points), Normals, Parameters; disabled
sdivide_3 = DivideSurface(Surface=reparameterize(srf_3), UCount=number_slider_35, VCount=number_slider_35)  # -> flatten(Points), Normals, flatten(Parameters); disabled
number_slider_41 = Slider(60, range=0..100)  # disabled
evalsrf_2 = EvaluateSurface(Surface=reparameterize(srf_4), Point=md_slider_3)  # -> Point, Normal, UDirection, VDirection, Frame; disabled
sdivide_4 = DivideSurface(Surface=srf_4, UCount=number_slider_36, VCount=number_slider_36)  # -> flatten(Points), Normals, Parameters; disabled
expression = Expression(x=dim_2.UDimension, y=number_slider_34, Expression="(x/y)/2")  # disabled
expression_2 = Expression(x=dim_3.UDimension, y=number_slider_35, Expression="(x/y)/2")  # disabled
expression_3 = Expression(x=dim_4.UDimension, y=number_slider_36, Expression="(x/y)/2")  # disabled
sdivide_5 = DivideSurface(Surface=reparameterize(srf_5), UCount=number_slider_38, VCount=number_slider_37)  # -> flatten(Points), Normals, flatten(Parameters); disabled
lng_6 = ListLength(List=pdecon.ZComponent)  # disabled
image_4 = ImageSampler(sdivide_3.Parameters, Filter="Value", Interpolate=False, Umax=1, Umin=0, Vmax=1, Vmin=0, Wrap=1)  # disabled
panel_36 = Panel("-0.6 to 0.7")  # disabled
dist = Distance(PointA=sdivide_2.Points, PointB=evalsrf.Point)  # disabled
panel_37 = Panel("0.1")  # disabled
dist_2 = Distance(PointA=sdivide_4.Points, PointB=evalsrf_2.Point)  # disabled
image_5 = ImageSampler(sdivide_5.Parameters, Filter="Value", Interpolate=False, Umax=1, Umin=0, Vmax=1, Vmin=0, Wrap=1)  # disabled
lng_7 = ListLength(List=pdecon.ZComponent)  # disabled
panel_38 = Panel("0.1")  # disabled
pdecon_2 = Deconstruct(Point=sdivide_5.Points)  # -> XComponent, YComponent, ZComponent; disabled
dom_3 = ConstructDomain(DomainStart=0, DomainEnd=number_slider_41)  # disabled
dom_4 = ConstructDomain(DomainStart=panel_37, DomainEnd=expression_2)  # disabled
bnd_2 = Bounds(Numbers=dist)  # disabled
dom_5 = ConstructDomain(DomainStart=panel_38, DomainEnd=expression)  # disabled
random_5 = Random(Range=panel_36, Number=lng_6, Seed=number_slider_39)  # disabled
bnd_3 = Bounds(Numbers=dist_2)  # disabled
panel_39 = Panel("0.4 to 1.4")  # disabled
remap_4 = RemapNumbers(Value=image_4, Source=Domain(0, 1), Target=dom_4)  # -> Mapped, Clipped; disabled
remap_5 = RemapNumbers(Value=image_5, Source=Domain(0, 1), Target=dom_3)  # -> Mapped, Clipped; disabled
pt_17 = ConstructPoint(XCoordinate=pdecon_2.XComponent, YCoordinate=pdecon_2.YComponent, ZCoordinate=remap_5.Mapped)  # disabled
jitter_2 = Jitter(List=random_5, Jitter=1, Seed=2)  # -> Values, Indices; disabled
remap_6 = RemapNumbers(Value=dist, Source=bnd_2, Target=dom_5)  # -> Mapped, Clipped; disabled
remap_7 = RemapNumbers(Value=dist_2, Source=bnd_3, Target=Domain(0, 1))  # -> Mapped, Clipped; disabled
number_slider_42 = Slider(1, range=0..10)  # disabled
random_6 = Random(Range=panel_39, Number=lng_7, Seed=number_slider_40)  # disabled
cir_7 = Circle(Plane=sdivide_3.Points, Radius=remap_4.Mapped)  # disabled
pt_18 = ConstructPoint(XCoordinate=random_5, YCoordinate=jitter_2.Values, ZCoordinate=pdecon.ZComponent)  # disabled
graph = GraphMapper(
    remap_7.Mapped,
    x0=0,
    x1=1,
    y0=0,
    y1=1,
    amplitude=0.4070284367,
    container_name="Perlin",
    decay=1,
    frequency=0.1,
    x_offset=0.496493578,
    y_offset=0.4070284367)  # disabled
number_slider_43 = Slider(683, range=0..1000)  # disabled
cir_8 = Circle(Plane=sdivide_2.Points, Radius=remap_6.Mapped)  # disabled
srfgrid_2 = SurfaceFromPoints(Points=pt_17, UCount=expr("x+1", number_slider_38), Interpolate=False)  # disabled
panel_40 = Panel("0.1")  # disabled
dom_6 = ConstructDomain(DomainStart=panel_40, DomainEnd=expression_3)  # disabled
edges = BrepEdges(Brep=srfgrid_2)  # -> Naked, Interior, NonManifold; disabled
panel_41 = Panel("-4")  # disabled
contour_2 = Contour(Shape=srfgrid_2, Point=Point(0, 0, 0), Direction=Vector(0, 0, 1), Distance=number_slider_42)  # -> flatten(Contours); disabled
number_slider_44 = Slider(10, range=0..100)  # disabled
cir_9 = Circle(Plane=pt_18, Radius=random_6)  # disabled
remap_8 = RemapNumbers(Value=graph, Source=Domain(0, 1), Target=dom_6)  # -> Mapped, Clipped; disabled
pt_19 = ConstructPoint(XCoordinate=0, YCoordinate=0, ZCoordinate=panel_41)  # disabled
popgeo_3 = PopulateGeometry(Geometry=srfgrid_2, Count=number_slider_43, Seed=1)  # disabled
cir_10 = Circle(Plane=sdivide_4.Points, Radius=remap_8.Mapped)  # disabled
end = EndPoints(Curve=contour_2)  # -> Start, End; disabled
lng_8 = ListLength(List=cir_9)  # disabled
number_slider_45 = Slider(0.74, range=0..1)  # disabled
pdecon_3 = Deconstruct(Point=end.End)  # -> XComponent, YComponent, ZComponent; disabled
srf_6 = Surface(cir_10)  # disabled
Z_5 = UnitZ(Factor=remap_8.Mapped)  # disabled
divide_6 = DivideCurve(Curve=cir_9, Count=number_slider_44, Kinks=False)  # -> simplify(Points), Tangents, Parameters; disabled
series_5 = Series(Start=0, Step=1, Count=lng_8)  # -> simplify(graft(Series)); disabled
project = Project(Geometry=edges.Naked, Plane=pt_19)  # -> Geometry, Transform; disabled
brep_cp_2 = BrepClosestPoint(Point=popgeo_3, Brep=srfgrid_2)  # -> Point, Normal, Distance; disabled
bnd_4 = Bounds(Numbers=pdecon_3.ZComponent)  # disabled
extr = Extrude(Base=srf_6, Direction=expr("x*3", Z_5))  # disabled
gradient_2 = Gradient(
    LowerLimit=0,
    UpperLimit=1,
    Parameter=graph,
    stops=[0: RGB(0, 235, 192), 0.167: RGB(129, 219, 200), 0.411: RGB(145, 194, 201), 0.765: RGB(211, 172, 250), 1: RGB(255, 138, 224)])  # disabled
rev_2 = ReverseList(List=divide_6.Points)  # disabled
pdecon_4 = Deconstruct(Point=brep_cp_2.Normal)  # -> XComponent, YComponent, ZComponent; disabled
join = JoinCurves(Curves=project.Geometry, Preserve=False)  # disabled
dedomain_2 = DeconstructDomain(Domain=bnd_4)  # -> Start, End; disabled
larger_2 = LargerThan(FirstNumber=pdecon_4.ZComponent, SecondNumber=number_slider_45)  # -> LargerThan, OrEqualTo; disabled
rulesrf = RuledSurface(CurveA=edges.Naked, CurveB=project.Geometry)  # disabled
shift_4 = ShiftList(List=rev_2, Shift=series_5, Wrap=True)  # disabled
shift_5 = ShiftList(List=divide_6.Points, Shift=series_5, Wrap=True)  # disabled
srf_7 = Surface(join)  # disabled
srf_8 = Surface(srfgrid_2)  # disabled
gradient_3 = Gradient(
    LowerLimit=dedomain_2.Start,
    UpperLimit=dedomain_2.End,
    Parameter=pdecon_3.ZComponent,
    stops=[0: RGB(252, 240, 18), 0.439: RGB(237, 222, 239), 1: RGB(119, 108, 175)])  # disabled
flip_4 = FlipMatrix(Data=shift_4)  # disabled
flip_5 = FlipMatrix(Data=shift_5)  # disabled
join_2 = BrepJoin(Breps=flatten([rulesrf, srf_7, srf_8]))  # -> Breps, Closed; disabled
cull_2 = CullPattern(List=popgeo_3, CullPattern=larger_2.LargerThan)  # disabled
mesh_2 = Mesh(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)  # disabled
pt_20 = Point(Point(193.7033997, -43.90905762, -1.575397253))  # disabled
crv_7 = Curve(cir_9)  # disabled
mesh_3 = Mesh(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)  # disabled
pline_3 = PolyLine(Vertices=flip_4, Closed=False)  # disabled
preview_3 = CustomPreview(Geometry=extr, Material=gradient_2)  # disabled
pline_4 = PolyLine(Vertices=flip_5, Closed=False)  # disabled
number_slider_46 = Slider(0.05, range=0..0.1)  # disabled
panel_42 = Panel("0.8 to 3")  # disabled
lng_9 = ListLength(List=cull_2)  # disabled
ln_12 = Line(StartPoint=pt_20, EndPoint=cull_2)  # disabled
preview_4 = CustomPreview(Geometry=contour_2, Material=gradient_3)  # disabled
random_7 = Random(Range=panel_42, Number=lng_9, Seed=2)  # disabled
move_8 = Move(Geometry=mesh_3, Motion=ln_12)  # -> Geometry, Transform; disabled
pipe_2 = Pipe(Curve=[pline_3, pline_4, crv_7], Radius=number_slider_46, Caps=0)  # disabled
scale_3 = Scale(Geometry=move_8.Geometry, Center=cull_2, Factor=random_7)  # -> Geometry, Transform; disabled
swatch = ColourSwatch(SwatchColor=RGB(255, 255, 255))  # disabled
swatch_2 = ColourSwatch(SwatchColor=RGB(186, 255, 233))  # disabled
preview_5 = CustomPreview(Geometry=scale_3.Geometry, Material=swatch_2)  # disabled
preview_6 = CustomPreview(Geometry=pipe_2, Material=swatch)  # disabled
xy = XYPlane(Origin=Point(0, 0, 0))  # disabled
md_slider_4 = MDSlider(
    SliderMode=0,
    slider_value=Point(0.4151164729, 0.438527177, 0.5),
    x_domain=Domain(0, 20),
    y_domain=Domain(0, 20),
    z_domain=Domain(0, 1))  # disabled
pt_21 = Point(<point referenced from the Rhino model>)  # disabled
number_slider_47 = Slider(2, range=0..10)  # disabled

number_slider_48 = Slider(2, range=0..10)  # disabled
pt_22 = Point(Point(12.78561104, 0.2460416245, 0))  # disabled
number_slider_49 = Slider(8, range=0..10)  # disabled
cir_11 = Circle(Plane=pt_22, Radius=1)  # disabled
series_6 = Series(Start=0, Step=number_slider_48, Count=number_slider_49)  # disabled
Z_6 = UnitZ(Factor=series_6)  # disabled
move_9 = Move(Geometry=cir_11, Motion=Z_6)  # -> Geometry, Transform; disabled
number_slider_50 = Slider(0.5, range=0..1)  # disabled
number_slider_51 = Slider(9, range=0..10)  # disabled
neg = Negative(Value=number_slider_50)  # disabled
dom_7 = ConstructDomain(DomainStart=number_slider_50, DomainEnd=neg)  # disabled
random_8 = Random(Range=dom_7, Number=number_slider_49, Seed=number_slider_51)  # disabled
jitter_3 = Jitter(List=random_8, Jitter=1, Seed=number_slider_51)  # -> Values, Indices; disabled
vec_2 = VectorXYZ(XComponent=random_8, YComponent=jitter_3.Values, ZComponent=0)  # -> Vector, Length; disabled
move_10 = Move(Geometry=move_9.Geometry, Motion=vec_2.Vector)  # -> Geometry, Transform; disabled
number_slider_52 = Slider(0.5, range=0..1)  # disabled
number_slider_53 = Slider(1.3, range=0..10)  # disabled
area_5 = Area(Geometry=move_10.Geometry)  # -> Area, Centroid; disabled
dom_8 = ConstructDomain(DomainStart=number_slider_52, DomainEnd=number_slider_53)  # disabled
random_9 = Random(Range=dom_8, Number=number_slider_49, Seed=number_slider_51)  # disabled
number_slider_54 = Slider(8, range=0..100)  # disabled
scale_4 = Scale(Geometry=move_10.Geometry, Center=area_5.Centroid, Factor=random_9)  # -> Geometry, Transform; disabled
divide_7 = DivideCurve(Curve=scale_4.Geometry, Count=number_slider_54, Kinks=False)  # -> Points, Tangents, Parameters; disabled
series_7 = Series(Start=0, Step=1, Count=number_slider_49)  # disabled
series_8 = Series(Start=0, Step=1, Count=number_slider_49)  # disabled
shift_6 = ShiftList(List=divide_7.Points, Shift=graft(series_7), Wrap=True)  # disabled
shift_7 = ShiftList(List=reverse(divide_7.Points), Shift=graft(series_8), Wrap=True)  # disabled
flip_6 = FlipMatrix(Data=shift_6)  # disabled
flip_7 = FlipMatrix(Data=shift_7)  # disabled
pline_5 = PolyLine(Vertices=flip_6, Closed=False)  # disabled
pline_6 = PolyLine(Vertices=flip_7, Closed=False)  # disabled
number_slider_55 = Slider(0.05, range=0..0.1)  # disabled
merge_2 = Merge(Data1=pline_5, Data2=pline_6, Data3=scale_4.Geometry)  # disabled
pipe_3 = Pipe(Curve=merge_2, Radius=number_slider_55, Caps=0)  # disabled

number_slider_56 = Slider(41, range=0..100)  # disabled
number_slider_57 = Slider(4, range=0..10)  # disabled

number_slider_58 = Slider(20, range=0..100)  # disabled
pt_23 = Point(md_slider_4)  # disabled
panel_43 = Panel("flujo .ej 02-- vectores")  # disabled
sqgrid_3 = Square(Plane=xy, Size=1, ExtentX=number_slider_58, ExtentY=number_slider_58)  # -> Cells, Points; disabled
number_slider_59 = Slider(0, range=0..100)  # disabled
number_slider_60 = Slider(1, range=0..1)  # disabled
ln_13 = Line(StartPoint=sqgrid_3.Points, EndPoint=pt_23)  # -> flatten(Line); disabled
len_2 = Length(Curve=ln_13)  # disabled
dom_9 = ConstructDomain(DomainStart=number_slider_59, DomainEnd=number_slider_60)  # disabled
bnd_5 = Bounds(Numbers=len_2)  # disabled
remap_9 = RemapNumbers(Value=len_2, Source=bnd_5, Target=dom_9)  # -> Mapped, Clipped; disabled
graph_2 = GraphMapper(
    remap_9.Clipped,
    x0=0,
    x1=1,
    y0=0,
    y1=1,
    container_name="Bezier",
    cpx=[0, 0, 0.7696727514, 1],
    cpy=[0, 1, 0.4840176105, 1])  # disabled
division_9 = Division(A=graph_2, B=2)  # disabled
gradient_4 = Gradient(LowerLimit=0, UpperLimit=1, Parameter=graph_2, stops=[0: RGB(0, 128, 0), 0.517: RGB(255, 0, 0), 1: RGB(255, 255, 0)])  # disabled
cir_12 = Circle(Plane=flatten(sqgrid_3.Points), Radius=division_9)  # disabled
preview_7 = CustomPreview(Geometry=cir_12, Material=gradient_4)  # disabled

md_slider_5 = MDSlider(
    SliderMode=0,
    slider_value=Point(0.6244491949, 0.3808087605, 0.5),
    x_domain=Domain(0, 1),
    y_domain=Domain(0, 1),
    z_domain=Domain(0, 1))  # disabled
panel_44 = Panel("0,0,0")  # disabled
panel_45 = Panel("""listas basico-02
flaten 
grafftem""")  # disabled

brep = Brep([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])  # disabled
debrep = DeconstructBrep(Brep=brep)  # -> Faces, Edges, Vertices; disabled
number_slider_61 = Slider(5, range=0..10)  # disabled
panel_46 = Panel(brep)  # disabled
panel_47 = Panel(debrep.Faces)  # disabled
item_4 = ListItem(List=debrep.Faces, Index=number_slider_61, Wrap=True)  # -> simplify(Item); disabled
item_5 = ListItem(List=debrep.Faces, Index=number_slider_61, Wrap=True)  # disabled
item_6 = ListItem(List=debrep.Faces, Index=number_slider_61, Wrap=True)  # -> flatten(Item); disabled
panel_48 = Panel(item_5)  # disabled
panel_49 = Panel(item_4)  # disabled
panel_50 = Panel(item_6)  # disabled
loft = Loft(Curves=item_5, Options={Adjust=False, Closed=False, LoftEnds=0, LoftSimp=0, LoftType=0, Rebuild=10, Refit=0.01})  # disabled
loft_2 = Loft(Curves=item_6, Options={Adjust=False, Closed=False, LoftEnds=0, LoftSimp=0, LoftType=0, Rebuild=10, Refit=0.01})  # disabled
panel_51 = Panel(loft)  # disabled

xy_2 = XYPlane(Origin=panel_44)  # disabled
panel_52 = Panel("05")  # disabled
neg_2 = Negative(Value=number_slider_57)  # disabled
sqgrid_4 = Square(Plane=xy_2, Size=number_slider_47, ExtentX=number_slider_56, ExtentY=number_slider_56)  # -> Cells, Points; disabled
inc = Includes(Domain=Domain(0, 1))  # -> Includes, Deviation; disabled
remap_10 = RemapNumbers(Source=Domain(0, 1), Target=Domain(0, 1))  # -> Mapped, Clipped; disabled
multiplication_4 = Multiplication(A=number_slider_47, B=number_slider_56)  # disabled
number_slider_62 = Slider(13, range=0..30)  # disabled
dom_10 = ConstructDomain(DomainStart=neg_2, DomainEnd=number_slider_57)  # disabled
panel_53 = Panel(" 0 to 40")  # disabled
brep_2 = Brep([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])  # disabled
number_slider_63 = Slider(5, range=0..10)  # disabled
dom_11 = ConstructDomain(DomainStart=0, DomainEnd=1)  # disabled
dedomain_3 = DeconstructDomain()  # -> Start, End; disabled
rectangle_3 = Rectangle(Plane=PlaneXY(0, 0, 0), XSize=dom_10, YSize=dom_10, Radius=0)  # -> Rectangle, Length; disabled
multiplication_5 = Multiplication(A=multiplication_4, B=md_slider_5)  # disabled

# ---- group: super puntos
panel_54 = Panel("pùntos matriz")  # disabled
pt_24 = Point(flatten(sqgrid_4.Points))  # disabled

# ----
panel_55 = Panel(brep_2)  # disabled
debrep_2 = DeconstructBrep(Brep=brep_2)  # -> Faces, Edges, Vertices; disabled

panel_56 = Panel("punto gravedad")  # disabled
pt_25 = Point(multiplication_5)  # disabled

consec = ConsecutiveDomains(Numbers=[0, 0.5, 1, 1.5, 2], Additive=True)  # disabled
range = Range(Domain=panel_53, Steps=number_slider_62)  # disabled
bnd_6 = Bounds()  # disabled
panel_57 = Panel("2")  # disabled
Z_7 = UnitZ(Factor=range)  # disabled
fdom = FindDomain(Strict=False)  # -> Index, Neighbour; disabled
div = DivideDomain(Domain=Domain(0, 1), Count=10)  # disabled
item_7 = ListItem(List=debrep_2.Faces, Index=number_slider_63, Wrap=True)  # disabled
dist_3 = Distance(PointA=pt_24, PointB=pt_25)  # disabled
division_10 = Division(A=number_slider_47, B=panel_57)  # disabled
panel_58 = Panel("0.05")  # disabled
move_11 = Move(Geometry=rectangle_3.Rectangle, Motion=Z_7)  # -> Geometry, Transform; disabled
bnd_7 = Bounds(Numbers=dist_3)  # disabled
number_slider_64 = Slider(2, range=0..10)  # disabled
number_slider_65 = Slider(2, range=0..10)  # disabled
dom_12 = ConstructDomain(DomainStart=panel_58, DomainEnd=division_10)  # disabled
number_slider_66 = Slider(4, range=0..10)  # disabled
number_slider_67 = Slider(0.18, range=0..1)  # disabled
edges_2 = BrepEdges(Brep=item_7)  # -> Naked, Interior, NonManifold; disabled
crv_8 = Curve(<curve referenced from the Rhino model>)  # disabled
area_6 = Area(Geometry=move_11.Geometry)  # -> Area, Centroid; disabled
number_slider_68 = Slider(7, range=0..10)  # disabled
remap_11 = RemapNumbers(Value=dist_3, Source=bnd_7, Target=dom_12)  # -> Mapped, Clipped; disabled
join_3 = JoinCurves(Curves=edges_2.Naked, Preserve=False)  # -> flatten(Curves); disabled

flatten_2 = FlattenTree(Path="{0}")  # disabled
simplify = SimplifyTree(Front=False)  # disabled
graft_2 = GraftTree(IncludeEmptyLists=True, IncludeNullItems=True)  # disabled

lng_10 = ListLength(List=area_6.Centroid)  # disabled
panel_59 = Panel(" 0.3 to 2.5")  # disabled
graph_3 = GraphMapper(
    remap_11.Mapped,
    x0=0,
    x1=1,
    y0=0,
    y1=1,
    amplitude=0.3878102303,
    container_name="Perlin",
    decay=1,
    frequency=0.1833294164,
    x_offset=0.007276492193,
    y_offset=0.5302554965)  # disabled
stair = Escalera_2(crv=<geometry referenced from the Rhino model>, C=1)  # disabled
escalera = ESCALERA(altura_libre=number_slider_66, conta_huella=number_slider_67, crv=crv_8, tipe=number_slider_64, offset=number_slider_65)  # -> B, B_2; disabled
range_2 = Range(Domain=Domain(0, 1), Steps=10)  # disabled
flatten_3 = FlattenTree(Path="{0}")  # disabled
graft_3 = GraftTree(IncludeEmptyLists=True, IncludeNullItems=True)  # disabled
random_10 = Random(Range=panel_59, Number=lng_10, Seed=number_slider_68)  # disabled
loft_3 = Loft(Curves=join_3, Options={Adjust=False, Closed=False, LoftEnds=0, LoftSimp=0, LoftType=0, Rebuild=10, Refit=0.01})  # disabled
scale_5 = Scale(Geometry=move_11.Geometry, Center=area_6.Centroid, Factor=random_10)  # -> Geometry, Transform; disabled
cir_13 = Circle(Plane=pt_24, Radius=graph_3)  # disabled
loft_4 = Loft(
    Curves=scale_5.Geometry,
    Options={Adjust=False, Closed=False, LoftEnds=0, LoftSimp=0, LoftType=3, Rebuild=10, Refit=0.01})  # disabled
bnd_8 = Bounds(Numbers=graph_3)  # disabled
dedomain_4 = DeconstructDomain(Domain=bnd_8)  # -> Start, End; disabled
gradient_5 = Gradient(
    LowerLimit=dedomain_4.Start,
    UpperLimit=dedomain_4.End,
    Parameter=graph_3,
    stops=[0: RGB(0, 235, 192), 0.167: RGB(129, 219, 200), 0.411: RGB(145, 194, 201), 0.765: RGB(211, 172, 250), 1: RGB(255, 138, 224)])  # disabled
number_slider_69 = Slider(10, range=0..30)  # disabled

# ---- group: OPCION A
number_slider_70 = Slider(6, range=0..10)  # disabled
number_slider_71 = Slider(3, range=0..10)  # disabled
series_9 = Series(Start=0, Step=number_slider_71, Count=number_slider_70)  # disabled

# ---- group: OPCION 2
number_slider_72 = Slider(8, range=0..10)  # disabled
panel_60 = Panel("0 TO 40")  # disabled
range_3 = Range(Domain=panel_60, Steps=number_slider_72)  # disabled

# ----
neg_3 = Negative(Value=number_slider_69)  # disabled
preview_8 = CustomPreview(Geometry=cir_13, Material=gradient_5)  # disabled
number_slider_73 = Slider(4, range=0..10)  # disabled
dom_13 = ConstructDomain(DomainStart=neg_3, DomainEnd=number_slider_69)  # disabled
brep_3 = Brep([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])  # disabled
number_slider_74 = Slider(4, range=0..10)  # disabled
rectangle_4 = Rectangle(Plane=PlaneXY(0, 0, 0), XSize=dom_13, YSize=dom_13, Radius=number_slider_73)  # -> Rectangle, Length; disabled
debrep_3 = DeconstructBrep(Brep=brep_3)  # -> Faces, Edges, Vertices; disabled
Z_8 = UnitZ(Factor=range_3)  # disabled
move_12 = Move(Geometry=rectangle_4.Rectangle, Motion=Z_8)  # -> Geometry, Transform; disabled
number_slider_75 = Slider(4, range=0..10)  # disabled
item_8 = ListItem(List=debrep_3.Faces, Index=number_slider_74, Wrap=True)  # disabled
lng_11 = ListLength(List=Z_8)  # disabled
panel_61 = Panel(" 0.1 TO 2")  # disabled
area_7 = Area(Geometry=move_12.Geometry)  # -> Area, Centroid; disabled
edges_3 = BrepEdges(Brep=item_8)  # -> Naked, Interior, NonManifold; disabled
random_11 = Random(Range=panel_61, Number=lng_11, Seed=number_slider_75)  # disabled
join_4 = JoinCurves(Curves=edges_3.Naked, Preserve=False)  # -> flatten(Curves); disabled
number_slider_76 = Slider(3, range=0..10)  # disabled
scale_6 = Scale(Geometry=move_12.Geometry, Center=area_7.Centroid, Factor=random_11)  # -> Geometry, Transform; disabled
number_slider_77 = Slider(6, range=0..100)  # disabled
loft_5 = Loft(Curves=join_4, Options={Adjust=False, Closed=False, LoftEnds=0, LoftSimp=0, LoftType=0, Rebuild=10, Refit=0.01})  # disabled
number_slider_78 = Slider(41, range=0..100)  # disabled
panel_62 = Panel("2")  # disabled
division_11 = Division(A=number_slider_78, B=panel_62)  # disabled
loft_opt = LoftOptions(Closed=False, Adjust=False, Rebuild=0, Refit=0, Type=number_slider_76)  # disabled
number_slider_79 = Slider(7, range=0..10)  # disabled
number_slider_80 = Slider(10, range=0..10)  # disabled
neg_4 = Negative(Value=division_11)  # disabled
loft_6 = Loft(Curves=scale_6.Geometry, Options=loft_opt)  # disabled
sqgrid_5 = Square(Plane=PlaneXY(0, 0, 0), Size=number_slider_78, ExtentX=number_slider_77, ExtentY=number_slider_77)  # -> Cells, Points; disabled
dom_14 = ConstructDomain(DomainStart=neg_4, DomainEnd=division_11)  # disabled
lng_12 = ListLength(List=sqgrid_5.Points)  # disabled
flatten_4 = FlattenTree(Tree=lng_12, Path="{0}")  # disabled
index_2 = ItemIndex(List=flatten_4, Item=flatten_4)  # disabled
pt_26 = Point(sqgrid_5.Points)  # disabled
addition_2 = Addition(A=index_2, B=number_slider_79)  # disabled
random_12 = Random(Range=dom_14, Number=lng_12, Seed=graft(addition_2))  # disabled
jitter_4 = Jitter(List=random_12, Jitter=1, Seed=2)  # -> Values, Indices; disabled
pt_27 = ConstructPoint(XCoordinate=random_12, YCoordinate=jitter_4.Values, ZCoordinate=0)  # disabled
pt_28 = Point(Point(0, 0, 0))  # disabled
vec2pt_2 = Vector2Pt(PointA=pt_28, PointB=pt_27, Unitize=False)  # -> Vector, Length; disabled
move_13 = Move(Geometry=pt_26, Motion=vec2pt_2.Vector)  # -> Geometry, Transform; disabled
pline_7 = PolyLine(Vertices=move_13.Geometry, Closed=False)  # -> flatten(Polyline); disabled
shift_8 = ShiftList(List=pline_7, Shift=1, Wrap=True)  # disabled
explode = Explode(Curve=shift_8, Recursive=True)  # -> Segments, Vertices; disabled
explode_2 = Explode(Curve=pline_7, Recursive=True)  # -> Segments, Vertices; disabled
rulesrf_2 = RuledSurface(CurveA=explode.Segments, CurveB=explode_2.Segments)  # disabled
number_slider_81 = Slider(20, range=0..100)  # disabled
flip_8 = FlipMatrix(Data=rulesrf_2)  # disabled
panel_63 = Panel("0")  # disabled
cull_i = CullIndex(List=reverse(flip_8), Indices=panel_63, Wrap=True)  # disabled
Z_9 = UnitZ(Factor=number_slider_81)  # disabled
move_14 = Move(Geometry=cull_i, Motion=Z_9)  # -> Geometry, Transform; disabled
number_slider_82 = Slider(0.1, range=0..0.1)  # disabled
area_8 = Area(Geometry=cull_i)  # -> Area, Centroid; disabled
area_9 = Area(Geometry=move_14.Geometry)  # -> Area, Centroid; disabled
scale_7 = Scale(Geometry=move_14.Geometry, Center=area_9.Centroid, Factor=number_slider_82)  # -> Geometry, Transform; disabled
pt_29 = Point(Point(120.7207192, 112.9136607, 18.6453686))  # disabled
dist_4 = Distance(PointA=pt_29, PointB=flatten(area_9.Centroid))  # disabled
panel_64 = Panel("2")  # disabled
division_12 = Division(A=number_slider_78, B=panel_64)  # disabled
ln_14 = Line(StartPoint=pt_29, EndPoint=flatten(area_9.Centroid))  # disabled
number_slider_83 = Slider(0.9, range=0..1)  # disabled
neg_5 = Negative(Value=division_12)  # disabled
bnd_9 = Bounds(Numbers=dist_4)  # disabled
dom_15 = ConstructDomain(DomainStart=division_12, DomainEnd=neg_5)  # disabled
remap_12 = RemapNumbers(Value=dist_4, Source=bnd_9, Target=dom_15)  # -> Mapped, Clipped; disabled
scale_8 = Scale(Geometry=cull_i, Center=area_8.Centroid, Factor=number_slider_83)  # -> flatten(Geometry), Transform; disabled
amp_2 = Amplitude(Vector=ln_14, Amplitude=remap_12.Mapped)  # disabled
move_15 = Move(Geometry=flatten(scale_7.Geometry), Motion=amp_2)  # -> Geometry, Transform; disabled
rulesrf_3 = RuledSurface(CurveA=scale_8.Geometry, CurveB=move_15.Geometry)  # disabled
cap = CapHoles(Brep=rulesrf_3)  # -> flatten(Brep); disabled

# ==== cluster Makenacho
polygon = Polygon(Plane=PlaneXY(0, 0, 0), Radius=3, Segments=3, FilletRadius=0.2)  # -> Polygon, Length
rotate = Rotate(Geometry=polygon.Polygon, Angle=1.570796327, Plane=PlaneXY(0, 0, 0))  # -> Geometry, Transform
curvepoint = PointOnCurve(rotate.Geometry, parameter=0.479)
boundary = BoundarySurfaces(Edges=rotate.Geometry)
popgeo = PopulateGeometry(Geometry=boundary, Count=100, Seed=1)
scale = Scale(Geometry=popgeo, Center=Point(0, 0, 0), Factor=0.98)  # -> Geometry, Transform
panel = Panel("""225,131,15,170
105,131,15,170""")
cir = Circle(Plane=scale.Geometry, Radius=0.04)
tag = TextTag3D(Location=curvepoint, Text="NFCM", Size=0.5, Colour=RGBA(130, 120, 81, 215), Justification=2)
preview = CustomPreview(Geometry=graft([boundary, cir]), Material=graft(panel))

# ==== cluster Escalera_2
num = ClusterInput()
num_2 = Number(num)
crv = ClusterInput()
ch = ClusterInput()
crv_2 = Curve(crv)
expression = Expression(altura_libre=num_2, ch=ch, Expression="altura_libre/ch")
explode = Explode(Curve=crv_2, Recursive=True)  # -> Segments, Vertices
round = Round(Number=expression)  # -> Nearest, Floor, Ceiling
n_escalones = Panel(round.Nearest)
len = Length(Curve=explode.Segments)
len_2 = Length(Curve=crv_2)
expression_2 = Expression(altura_libre=num_2, n_escalones=round.Nearest, Expression="altura_libre/n_escalones")
expression_3 = Expression(long_seg=len, n_escalones=n_escalones, longitud_total=len_2, Expression="(long_seg*n_escalones)/longitud_total")
panel = Panel(expression_2)
expression_4 = Expression(ch_real=panel, Expression="0.63-(2*ch_real)")
huella = Panel(expression_4)
crv_3 = Curve(explode.Segments)
round_2 = Round(Number=expression_3)  # -> Nearest, Floor, Ceiling
divdist = DivideDistance(Curve=crv_3, Distance=huella)  # -> Points, Tangents, Parameters
huella_2 = Panel(expression_4)
number_slider = Slider(2, range=0..10)
division = Division(A=round_2.Nearest, B=number_slider)
lng = ListLength(List=divdist.Points)
division_2 = Division(A=lng, B=number_slider)  # -> flatten(Result)
addition = Addition(A=division_2, B=division)
subtraction = Subtraction(A=division_2, B=division)
round_3 = Round(Number=subtraction)  # -> Nearest, Floor, Ceiling
round_4 = Round(Number=addition)  # -> Nearest, Floor, Ceiling
dom = ConstructDomain(DomainStart=round_3.Nearest, DomainEnd=round_4.Nearest)  # -> graft(Domain)
subset = SubList(List=divdist.Points, Domain=graft(dom), Wrap=True)  # -> List, Index
panel_2 = Panel(dom)
cull_i = CullIndex(List=subset.List, Indices=Slider(0, range=0..100), Wrap=True)
crv_4 = Curve(crv_2)
C = ClusterInput()
x = ClusterInput()
neg = Negative(Value=x)
offset = OffsetCurve(Curve=crv_4, Distance=neg, Plane=PlaneXY(0, 0, 0), Corners=C)
pull = PullPoint(Point=cull_i, Geometry=offset, ClosestOnly=True)  # -> ClosestPoint, Distance
ln = Line(StartPoint=cull_i, EndPoint=pull.ClosestPoint)
Z = UnitZ(Factor=Slider(1.5, range=0..10))
extr = Extrude(Base=ln, Direction=Z)
neg_2 = Negative(Value=Z)
division_3 = Division(A=neg_2, B=Slider(2, range=0..10))
rulesrf = RuledSurface(CurveA=crv_4, CurveB=offset)
move = Move(Geometry=extr, Motion=division_3)  # -> Geometry, Transform
crv_5 = Curve(flatten(ln))
splitmul = SplitBrepMultiple(Brep=rulesrf, Cutters=flatten(move.Geometry))
cull_i_2 = CullIndex(List=splitmul, Indices=Slider(0, range=0..100), Wrap=True)
ch_real = Panel(expression_2)
lng_2 = ListLength(List=cull_i_2)
series = Series(Start=ch_real, Step=ch_real, Count=lng_2)
Z_2 = UnitZ(Factor=ch_real)
Z_3 = UnitZ(Factor=series)
move_2 = Move(Geometry=crv_5, Motion=Z_3)  # -> Geometry, Transform
neg_3 = Negative(Value=Z_2)
move_3 = Move(Geometry=cull_i_2, Motion=Z_3)  # -> Geometry, Transform
extr_2 = Extrude(Base=move_2.Geometry, Direction=neg_3)
join = BrepJoin(Breps=[extr_2, move_3.Geometry])  # -> Breps, Closed
B = ClusterOutput(join.Breps)

# ==== cluster ESCALERA
crv = ClusterInput()
altura_libre = ClusterInput()
crv_2 = Curve(crv)
altura_libre_2 = Number(altura_libre)
conta_huella = ClusterInput()
fillet = Fillet(Curve=crv_2, Radius=Slider(0.3, range=0..1))
tipe = ClusterInput()
offset = ClusterInput()
merge = Merge(Data1=crv_2, Data2=fillet)  # -> flatten(Result)
division = Division(A=altura_libre_2, ContaHuella=conta_huella)
tipe_2 = Number(tipe)
offset_2 = Number(offset)
neg = Negative(Value=offset_2)
item = ListItem(List=merge, Index=expr("x-1", tipe_2), Wrap=True)
round = Round(Number=division)  # -> Nearest, Floor, Ceiling
division_2 = Division(A=altura_libre_2, B=round.Nearest)
divide = DivideCurve(Curve=item, Count=round.Nearest, Kinks=False)  # -> Points, Tangents, Parameters
offset_3 = OffsetCurve(Curve=item, Distance=neg, Plane=PlaneXY(0, 0, 0), Corners=tipe_2)
loft = Loft(
    Curves=flatten([offset_3, item]),
    Options={Adjust=False, Closed=False, LoftEnds=0, LoftSimp=0, LoftType=0, Rebuild=10, Refit=0.01})
pull = PullPoint(Point=divide.Points, Geometry=offset_3, ClosestOnly=True)  # -> ClosestPoint, Distance
series = Series(Start=division_2, Step=division_2, Count=round.Nearest)
ln = Line(StartPoint=divide.Points, EndPoint=pull.ClosestPoint)
Z = UnitZ(Factor=series)
srfsplit = SurfaceSplit(Surface=loft, Curves=ln)
area = Area(Geometry=srfsplit)  # -> Area, Centroid
crv_cp = CurveClosestPoint(Point=area.Centroid, Curve=item)  # -> Point, Parameter, Distance
sort = SortList(Keys=crv_cp.Parameter, ValuesA=srfsplit)  # -> Keys, ValuesA
move = Move(Geometry=ln, Motion=Z)  # -> Geometry, Transform
lng = ListLength(List=move.Geometry)
move_2 = Move(Geometry=sort.ValuesA, Motion=Z)  # -> Geometry, Transform
subtraction = Subtraction(A=lng, B=1)
cull_i = CullIndex(List=move.Geometry, Indices=flatten(subtraction), Wrap=True)
neg_2 = Negative(Value=division_2)
Z_2 = UnitZ(Factor=neg_2)
extr = Extrude(Base=cull_i, Direction=Z_2)
join = BrepJoin(Breps=[move_2.Geometry, extr])  # -> Breps, Closed
B = ClusterOutput(join.Breps)
edges = BrepEdges(Brep=join.Breps)  # -> Naked, Interior, NonManifold
len = Length(Curve=edges.Naked)
similar = Similarity(FirstNumber=len, SecondNumber=offset_2, Threshold=0.1)  # -> Similarity, AbsoluteDifference
cull = CullPattern(List=edges.Naked, CullPattern=invert(similar.Similarity))
join_2 = JoinCurves(Curves=cull, Preserve=False)
topoly = CurveToPolyline(Curve=join_2, ToleranceDistance=0, ToleranceAngle=degrees(Slider(9, range=0..100)))  # -> Polyline, Segments
redpline = Reduce(Polyline=topoly.Polyline, Tolerance=Slider(0.21, range=0..1))  # -> simplify(graft(Polyline)), Reduction
smoothpline = SmoothPolyline(Polyline=topoly.Polyline, Strength=1, Times=Slider(2, range=0..10))  # -> simplify(graft(Polyline))
merge_2 = Merge(Data1=redpline.Polyline, Data2=smoothpline)
flip = FlipMatrix(Data=merge_2)
tstat = TreeStatistics(Tree=flip)  # -> Paths, Length, Count
item_2 = ListItem(List=tstat.Paths, Index=expr("x-1", tipe_2), Wrap=True)
branch = TreeBranch(Tree=flip, Path=item_2, MaintainPaths=True)
B_2 = ClusterOutput(branch)
