# Grasshopper definition dia1-introducción.gh (Grasshopper 1.0.7)
# Copyright: N.FC.M
# plug-ins: Bifocals

# CLASE
# INDRODUCCION - LISTAS
panel = Panel("interface")
panel_2 = Panel("""guardado
vistas de componentes
componentes
numerico- basico""")  # disabled
panel_3 = Panel("02")  # disabled
panel_4 = Panel("componentes - referencias")  # disabled

# ---- group: componentes-refencias a rinho
pln = Plane(PlaneXY(9.674578441, -12.88160984, 0))  # disabled
crv = Curve(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)  # disabled
pt = Point(Point(-16.80431175, 3.270487482, 0))  # disabled
mesh = Mesh(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)  # disabled
geo = Geometry([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, Point(-16.80431175, 3.270487482, 0)])  # disabled
srf = Surface(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)  # disabled
brep = Brep(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)  # disabled

# ----
panel_5 = Panel(pt)  # disabled
panel_6 = Panel(srf)  # disabled
panel_7 = Panel(brep)  # disabled
panel_8 = Panel(mesh)  # disabled
panel_9 = Panel(pln)  # disabled
panel_10 = Panel(crv)  # disabled
panel_11 = Panel(geo)  # disabled
make_nacho = Makenacho()  # disabled
panel_12 = Panel("01")  # disabled
# SESION  - 1 -
# GRASHOPPER BASICO {1}
nacho = NACHO()
panel_13 = Panel("referencias objetos")  # disabled
plano_inicio = Plane(Plane(origin=(20.52585684, 14.51776229, 0), x=(0.9709457666, -0.2392996412, 0), y=(0.2392996412, 0.9709457666, 0)))  # disabled
pt_2 = Point(Point(27.56391527, 13.44042291, 0))  # disabled
brep_2 = Brep(<brep referenced from the Rhino model>)  # disabled
geo_2 = Geometry([<curve referenced from the Rhino model>, <brep referenced from the Rhino model>, <curve referenced from the Rhino model>, <brep referenced from the Rhino model>])  # disabled
crv_2 = Curve([<curve referenced from the Rhino model> x2])  # disabled
srf_2 = Surface(<surface referenced from the Rhino model>)  # disabled
pln_2 = Plane()  # disabled
panel_14 = Panel(geo_2)  # disabled
panel_15 = Panel(crv_2)  # disabled
panel_16 = Panel(srf_2)  # disabled
panel_17 = Panel(brep_2)  # disabled
panel_18 = Panel(plano_inicio)  # disabled
panel_19 = Panel(pt_2)  # disabled

# ---- group: booleanos
panel_20 = Panel("""0 - FALSE
1 - TRUE""")  # disabled
toggle = BooleanToggle(True)  # disabled
button = Button()  # disabled
panel_21 = Panel(button)  # disabled

# ----
toggle_2 = BooleanToggle(False)  # disabled
toggle_3 = BooleanToggle(False)  # disabled
button_2 = Button()  # disabled
panel_22 = Panel("""true = 1
false = 0""")  # disabled
bool = Boolean()  # disabled
number_slider = Slider(1, range=0..10)  # disabled
pt_3 = Point(Point(0, 0, 0))  # disabled
number_slider_2 = Slider(2, range=0..10)  # disabled
number_slider_3 = Slider(72, range=0..100)  # disabled
num = Number([toggle_3, button_2])  # disabled
panel_23 = Panel(num)  # disabled
sph = Sphere(Base=pt_3, Radius=number_slider)  # disabled
number_slider_4 = Slider(8, range=0..10)  # disabled

number_slider_5 = Slider(13, range=0..100)  # disabled
pt_4 = ConstructPoint(XCoordinate=0, YCoordinate=0, ZCoordinate=0)  # disabled
number_slider_6 = Slider(3, range=0..100)  # disabled
sph_2 = Sphere(Base=pt_4, Radius=number_slider_5)  # disabled
popgeo = PopulateGeometry(Geometry=sph_2, Count=100, Seed=1)  # disabled
sph_3 = Sphere(Base=popgeo, Radius=number_slider_6)  # disabled

crv_3 = Curve([<curve referenced from the Rhino model> x3])  # disabled
len = Length(Curve=crv_3)  # disabled
popgeo_2 = PopulateGeometry(Geometry=sph, Count=number_slider_3, Seed=number_slider_2)  # disabled
srf_cp = SurfaceClosestPoint(Point=popgeo_2, Surface=sph)  # -> Point, UVPoint, Distance; disabled
division = Division(A=len, B=number_slider_4)  # disabled
ln = Line(StartPoint=pt_3, EndPoint=popgeo_2)  # disabled
number_slider_7 = Slider(0.3, range=0..1)  # disabled
Z = UnitZ(Factor=division)  # disabled
number_slider_8 = Slider(0.2, range=0..1)  # disabled
evalsrf = EvaluateSurface(Surface=sph, Point=srf_cp.UVPoint)  # -> Point, Normal, UDirection, VDirection, Frame; disabled
number_slider_9 = Slider(1, range=0..1)  # disabled
number_slider_10 = Slider(1, range=0..1)  # disabled

number_slider_11 = Slider(6, range=0..10)  # disabled
number_slider_12 = Slider(7, range=0..10)  # disabled
number_slider_13 = Slider(4, range=0..10)  # disabled
pt_5 = ConstructPoint(XCoordinate=number_slider_11, YCoordinate=number_slider_12, ZCoordinate=number_slider_13)  # disabled
pt_6 = ConstructPoint(XCoordinate=0, YCoordinate=0, ZCoordinate=0)  # disabled
box = Box2Pt(PointA=pt_6, PointB=pt_5, Plane=PlaneXY(0, 0, 0))  # disabled

number_slider_14 = Slider(0, range=0..10)  # disabled

# ---- group: basico-flujo-longitud
valor_de_division = Slider(5, range=0..10)  # disabled
crv_4 = Curve([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])  # disabled
len_2 = Length(Curve=crv_4)  # disabled
division_2 = Division(A=len_2, B=valor_de_division)  # disabled
z = UnitZ(Factor=division_2)  # disabled
extr = Extrude(Base=crv_4, Direction=z)  # disabled
cap = CapHoles(Brep=extr)  # disabled

# ----
number_slider_15 = Slider(0, range=0..100)  # disabled
extr_2 = Extrude(Base=crv_3, Direction=Z)  # disabled
number_slider_16 = Slider(5, range=0..10)  # disabled
number_slider_17 = Slider(2, range=0..10)  # disabled
amp = Amplitude(Vector=ln, Amplitude=number_slider_7)  # disabled
amp_2 = Amplitude(Vector=ln, Amplitude=number_slider_8)  # disabled
pln_3 = Plane(evalsrf.Frame)  # disabled
number_slider_18 = Slider(0.05, range=0..0.1)  # disabled
number_slider_19 = Slider(0.1, range=0..0.1)  # disabled
panel_24 = Panel("03")  # disabled
panel_25 = Panel("flujos basicos")  # disabled
pt_7 = ConstructPoint(XCoordinate=number_slider_15, YCoordinate=number_slider_15, ZCoordinate=number_slider_15)  # disabled
panel_26 = Panel("4")  # disabled
pt_8 = ConstructPoint(XCoordinate=number_slider_16, YCoordinate=number_slider_17, ZCoordinate=number_slider_17)  # disabled
move = Move(Geometry=pln_3, Motion=amp)  # -> Geometry, Transform; disabled
move_2 = Move(Geometry=pln_3, Motion=amp_2)  # -> Geometry, Transform; disabled
box_2 = Box2Pt(PointA=pt_7, PointB=pt_8, Plane=PlaneXY(0, 0, 0))  # disabled
cir = Circle(Plane=move.Geometry, Radius=number_slider_19)  # -> graft(Circle); disabled
cir_2 = Circle(Plane=move_2.Geometry, Radius=number_slider_18)  # -> graft(Circle); disabled
cir_3 = Circle(Plane=pln_3, Radius=number_slider_18)  # -> graft(Circle); disabled
pt_9 = Point()  # disabled
merge = Merge(Data1=cir, Data2=cir_2, Data3=cir_3)  # disabled
number_slider_20 = Slider(3.1, range=0..10)  # disabled
number_slider_21 = Slider(4, range=0..10)  # disabled
number_slider_22 = Slider(7, range=0..10)  # disabled
crv_5 = Curve([<curve referenced from the Rhino model> x3])  # disabled
len_3 = Length(Curve=crv_5)  # disabled
loft = Loft(Curves=merge, Options={Adjust=False, Closed=False, LoftEnds=0, LoftSimp=0, LoftType=0, Rebuild=10, Refit=0.01})  # disabled
bnd = Bounds(Numbers=len_3)  # disabled
panel_27 = Panel(" 1 to 3")  # disabled
panel_28 = Panel("5")  # disabled
pt_10 = ConstructPoint(XCoordinate=0, YCoordinate=0, ZCoordinate=0)  # disabled
pt_11 = ConstructPoint(XCoordinate=number_slider_20, YCoordinate=number_slider_21, ZCoordinate=number_slider_22)  # disabled
division_3 = Division(A=len_3, B=panel_28)  # disabled
srf_3 = Surface(crv_5)  # disabled
remap = RemapNumbers(Value=len_3, Source=bnd, Target=panel_27)  # -> Mapped, Clipped; disabled
number_slider_23 = Slider(7, range=0..10)  # disabled
box_3 = Box2Pt(PointA=pt_10, PointB=pt_11, Plane=PlaneXY(0, 0, 0))  # disabled
Z_2 = UnitZ(Factor=remap.Mapped)  # disabled
number_slider_24 = Slider(76, range=0..100)  # disabled
number_slider_25 = Slider(5, range=0..10)  # disabled
extr_3 = Extrude(Base=srf_3, Direction=Z_2)  # disabled
qsph = QuadSphere(Base=PlaneXY(0, 0, 0), Radius=1)  # disabled
sph_4 = Sphere(Base=PlaneXY(0, 0, 0), Radius=number_slider_23)  # disabled
number_slider_26 = Slider(94, range=0..100)  # disabled
number_slider_27 = Slider(59, range=0..100)  # disabled
srf_4 = Surface(<surface referenced from the Rhino model>)  # disabled
sph_5 = Sphere(Base=PlaneXY(0, 0, 0), Radius=1)  # disabled
popgeo_3 = PopulateGeometry(Geometry=sph_4, Count=number_slider_24, Seed=number_slider_25)  # disabled
brep_cp = BrepClosestPoint(Point=popgeo_3, Brep=sph_4)  # -> Point, Normal, Distance; disabled
popgeo_4 = PopulateGeometry(Geometry=sph_5, Count=number_slider_27, Seed=number_slider_26)  # disabled
panel_29 = Panel("""0
0.1
0.3""")  # disabled
panel_30 = Panel("""0.7
0.5
1.4""")  # disabled
panel_31 = Panel("""0
1
2""")  # disabled
pl = PlaneNormal(Origin=brep_cp.Point, ZAxis=brep_cp.Normal)  # disabled
graft = GraftTree(Tree=panel_29, IncludeEmptyLists=True, IncludeNullItems=True)  # disabled
brep_cp_2 = BrepClosestPoint(Point=popgeo_4, Brep=sph_5)  # -> Point, Normal, Distance; disabled
graft_2 = GraftTree(Tree=panel_31, IncludeEmptyLists=True, IncludeNullItems=True)  # disabled
graft_3 = GraftTree(Tree=panel_30, IncludeEmptyLists=True, IncludeNullItems=True)  # disabled
panel_32 = Panel("""0.09
0.05 
0.12""")  # disabled
amp_3 = Amplitude(Vector=brep_cp.Normal, Amplitude=graft_2)  # disabled
cir_4 = Circle(Plane=pl, Radius=graft_3)  # disabled
pl_2 = PlaneNormal(Origin=brep_cp_2.Point, ZAxis=brep_cp_2.Normal)  # disabled
amp_4 = Amplitude(Vector=brep_cp_2.Normal, Amplitude=graft)  # disabled
move_3 = Move(Geometry=cir_4, Motion=amp_3)  # -> Geometry, Transform; disabled
graft_4 = GraftTree(Tree=panel_32, IncludeEmptyLists=True, IncludeNullItems=True)  # disabled
move_4 = Move(Geometry=pl_2, Motion=amp_4)  # -> Geometry, Transform; disabled
flip = FlipMatrix(Data=move_3.Geometry)  # disabled
cir_5 = Circle(Plane=move_4.Geometry, Radius=graft_4)  # disabled
loft_2 = Loft(Curves=flip, Options={Adjust=False, Closed=False, LoftEnds=0, LoftSimp=0, LoftType=0, Rebuild=10, Refit=0.01})  # disabled
flip_2 = FlipMatrix(Data=cir_5)  # disabled
loft_3 = Loft(Curves=flip_2, Options={Adjust=False, Closed=False, LoftEnds=0, LoftSimp=0, LoftType=0, Rebuild=10, Refit=0.01})  # disabled

# ==== cluster Makenacho
polygon = Polygon(Plane=PlaneXY(0, 0, 0), Radius=3, Segments=3, FilletRadius=0.2)  # -> Polygon, Length
rotate = Rotate(Geometry=polygon.Polygon, Angle=1.570796327, Plane=PlaneXY(0, 0, 0))  # -> Geometry, Transform
curvepoint = PointOnCurve(rotate.Geometry, parameter=0.479)
boundary = BoundarySurfaces(Edges=rotate.Geometry)
popgeo = PopulateGeometry(Geometry=boundary, Count=100, Seed=1)
scale = Scale(Geometry=popgeo, Center=Point(0, 0, 0), Factor=0.98)  # -> Geometry, Transform
panel = Panel("""225,131,15,170
105,131,15,170""")
cir = Circle(Plane=scale.Geometry, Radius=0.04)
tag = TextTag3D(Location=curvepoint, Text="NFCM", Size=0.5, Colour=RGBA(130, 120, 81, 215), Justification=2)
preview = CustomPreview(Geometry=graft([boundary, cir]), Material=graft(panel))
