# Grasshopper definition sesion 3- flujo de trabajo - imagen.gh (Grasshopper 1.0.7)
# plug-ins: Bifocals

number_slider = Slider(10, range=0..10)  # disabled
# SESION  - 3 -
# GRASHOPPER BASICO {1}
# CLASE
# INTESTINO
nacho = NACHO()
crv = Curve([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])
# CLASE
# imagen
nacho_2 = NACHO()

number_slider_2 = Slider(40, range=0..100)  # disabled
crv_exterior = Curve(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)  # disabled
crv_interior = Curve(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)  # disabled
divide = DivideCurve(Curve=crv_exterior, Count=number_slider_2, Kinks=False)  # -> Points, Tangents, Parameters; disabled
pull = PullPoint(Point=divide.Points, Geometry=crv_interior, ClosestOnly=True)  # -> ClosestPoint, Distance; disabled
pdecon = Deconstruct(Point=graft(divide.Points))  # -> XComponent, YComponent, ZComponent; disabled
pdecon_2 = Deconstruct(Point=graft(pull.ClosestPoint))  # -> XComponent, YComponent, ZComponent; disabled
ln = Line(StartPoint=divide.Points, EndPoint=pull.ClosestPoint)  # disabled
len = Length(Curve=ln)  # disabled
avr = Average(Input=[pdecon.YComponent, pdecon_2.YComponent])  # disabled
avr_2 = Average(Input=[pdecon.XComponent, pdecon_2.XComponent])  # disabled
panel = Panel("3.5 to 8")  # disabled
bnd = Bounds(Numbers=len)  # disabled
pt = ConstructPoint(XCoordinate=avr_2, YCoordinate=avr, ZCoordinate=0)  # -> flatten(Point); disabled
remap = RemapNumbers(Value=len, Source=bnd, Target=panel)  # -> Mapped, Clipped; disabled
Z = UnitZ(Factor=remap.Mapped)  # disabled
number_slider_3 = Slider(0.7, range=0..10)  # disabled
move = Move(Geometry=pt, Motion=Z)  # -> Geometry, Transform; disabled
panel_2 = Panel("""1
0""")  # disabled
dispatch = Dispatch(List=move.Geometry, DispatchPattern=panel_2)  # -> ListA, ListB; disabled
Z_2 = UnitZ(Factor=number_slider_3)  # disabled
neg = Negative(Value=Z_2)  # disabled
move_2 = Move(Geometry=dispatch.ListB, Motion=neg)  # -> Geometry, Transform; disabled
weave = Weave(Pattern=[0, 1], Stream0=dispatch.ListA, Stream1=move_2.Geometry, NullGaps=False)  # disabled
A = Point(divide.Points)  # disabled
C = Point(pull.ClosestPoint)  # disabled
arc = Arc3Pt(PointA=A, PointB=weave, PointC=C)  # -> Arc, Plane, Radius; disabled
toggle = BooleanToggle(True)  # disabled
toggle_2 = BooleanToggle(False)  # disabled
loft_opt = LoftOptions(Closed=toggle_2, Adjust=False, Rebuild=0, Refit=toggle, Type=0)  # disabled
loft = Loft(Curves=arc.Arc, Options=loft_opt)  # disabled
number_slider_4 = Slider(100, range=0..100)  # disabled
sdivide = DivideSurface(Surface=loft, UCount=number_slider_4, VCount=10)  # -> flatten(Points), Normals, Parameters; disabled
pdecon_3 = Deconstruct(Point=sdivide.Points)  # -> XComponent, YComponent, ZComponent; disabled
bnd_2 = Bounds(Numbers=pdecon_3.ZComponent)  # disabled
dedomain = DeconstructDomain(Domain=bnd_2)  # -> Start, End; disabled
gradient = Gradient(
    LowerLimit=dedomain.Start,
    UpperLimit=dedomain.End,
    Parameter=pdecon_3.ZComponent,
    stops=[0: RGB(255, 255, 255), 1: RGB(0, 0, 0)])  # disabled
preview = CustomPreview(Geometry=sdivide.Points, Material=gradient)  # disabled

crv_2 = Curve(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)
rdiff = RegionDifference(CurvesA=crv_2, CurvesB=crv)
number_slider_5 = Slider(71, range=0..100)  # disabled
number_slider_6 = Slider(41, range=0..100)  # disabled
rectangle = Rectangle(Plane=PlaneXY(0, 0, 0), XSize=number_slider, YSize=number_slider, Radius=0)  # -> Rectangle, Length; disabled
boundary = BoundarySurfaces(Edges=rdiff)
crv_int = Curve(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)  # disabled
crv_ext = Curve(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)  # disabled
srf = Surface(reparameterize(rectangle.Rectangle))  # disabled
popgeo = PopulateGeometry(Geometry=boundary, Count=Slider(500, range=0..1000), Seed=1)
number_slider_7 = Slider(0, range=0..0.1)  # disabled
popgeo_2 = PopulateGeometry(Geometry=boundary, Count=Slider(6, range=0..10), Seed=1)
sdivide_2 = DivideSurface(Surface=srf, UCount=number_slider_5, VCount=number_slider_5)  # -> flatten(Points), Normals, flatten(Parameters); disabled
divide_2 = DivideCurve(Curve=crv_ext, Count=number_slider_6, Kinks=False)  # -> Points, Tangents, Parameters; disabled
end = EndPoints(Curve=crv_ext)  # -> Start, End; disabled
crv_ext_2 = Curve(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)  # disabled
division = Division(A=number_slider, B=number_slider_5)  # disabled
number_slider_8 = Slider(20, range=0..100)  # disabled
crv_int_2 = Curve(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)  # disabled
pull_2 = PullPoint(Point=popgeo, Geometry=popgeo_2, ClosestOnly=True)  # -> ClosestPoint, Distance
image = ImageSampler(sdivide_2.Parameters, Filter="Value", Interpolate=False, Umax=1, Umin=0, Vmax=1, Vmin=0, Wrap=1)  # disabled
pull_3 = PullPoint(Point=divide_2.Points, Geometry=crv_int, ClosestOnly=True)  # -> ClosestPoint, Distance; disabled
division_2 = Division(A=pull_2.Distance, B=Slider(7, range=0..10))
dom = ConstructDomain(DomainStart=number_slider_7, DomainEnd=expr("x/2", division))  # disabled
divide_3 = DivideCurve(Curve=crv_ext_2, Count=number_slider_8, Kinks=False)  # -> Points, Tangents, Parameters; disabled
vec2pt = Vector2Pt(PointA=popgeo, PointB=pull_2.ClosestPoint, Unitize=False)  # -> Vector, Length

# ---- group: opcion 1 - PERFIL
crv_3 = Curve(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)  # disabled
panel_3 = Panel("""1
0""")  # disabled
cull = CullPattern(List=divide.Parameters, CullPattern=panel_3)  # disabled
pln = Plane(PlaneXY(20.71905707, 54.71285541, 0))  # disabled
hframe = HorizontalFrame(Curve=crv_exterior, Parameter=cull)  # disabled
orient = Orient(Geometry=crv_3, Source=pln, Target=hframe)  # -> graft(Geometry), Transform; disabled
dispatch_2 = Dispatch(List=arc.Arc, DispatchPattern=[True, False])  # -> ListA, ListB; disabled
crv_4 = Curve(graft(dispatch_2.ListA))  # disabled
swp1 = Sweep1(Rail=crv_4, Sections=orient.Geometry, Miter=1)  # disabled

# ----
pull_4 = PullPoint(Point=divide_3.Points, Geometry=crv_int_2, ClosestOnly=True)  # -> ClosestPoint, Distance; disabled
crv_5 = Curve(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)
end_p = Point(pull_3.ClosestPoint)  # disabled
gradient_2 = Gradient(
    LowerLimit=0,
    UpperLimit=1,
    Parameter=image,
    stops=[0: RGB(237, 222, 239), 0.687: RGB(247, 144, 196), 1: RGB(119, 108, 175)])  # disabled
remap_2 = RemapNumbers(Value=image, Source=Domain(0, 1), Target=dom)  # -> Mapped, Clipped; disabled
start_p = Point(divide_2.Points)  # disabled
amp = Amplitude(Vector=vec2pt.Vector, Amplitude=division_2)
cir = Circle(Plane=sdivide_2.Points, Radius=remap_2.Mapped)  # disabled
panel_4 = Panel("""1
0
0
0""")
pdecon_4 = Deconstruct(Point=start_p)  # -> graft(XComponent), graft(YComponent), ZComponent; disabled
pdecon_5 = Deconstruct(Point=end_p)  # -> graft(XComponent), graft(YComponent), ZComponent; disabled
move_3 = Move(Geometry=popgeo, Motion=amp)  # -> Geometry, Transform
area = Area(Geometry=crv_5)  # -> Area, Centroid
pdecon_6 = Deconstruct(Point=graft(divide_3.Points))  # -> XComponent, YComponent, ZComponent; disabled
pdecon_7 = Deconstruct(Point=graft(pull_4.ClosestPoint))  # -> XComponent, YComponent, ZComponent; disabled
ln_2 = Line(StartPoint=divide_3.Points, EndPoint=pull_4.ClosestPoint)  # disabled
ln_3 = Line(StartPoint=divide_2.Points, EndPoint=pull_3.ClosestPoint)  # disabled
pt_2 = Point(divide_3.Points)  # disabled
pt_3 = Point(pull_4.ClosestPoint)  # disabled
number_slider_9 = Slider(8, range=0..100)  # disabled
number_slider_10 = Slider(19, range=0..100)  # disabled
cull_2 = CullPattern(List=move_3.Geometry, CullPattern=panel_4)
ln_4 = Line(StartPoint=area.Centroid, EndPoint=cull_2)
preview_2 = CustomPreview(Geometry=cir, Material=gradient_2)  # disabled
merge = Merge(Data1=pdecon_6.XComponent, Data2=pdecon_7.XComponent)  # disabled
len_2 = Length(Curve=ln_3)  # disabled
merge_2 = Merge(Data1=pdecon_6.YComponent, Data2=pdecon_7.YComponent)  # disabled
merge_3 = Merge(Data1=pdecon_4.YComponent, Data2=pdecon_5.YComponent)  # disabled
merge_4 = Merge(Data1=pdecon_4.XComponent, Data2=pdecon_5.XComponent)  # disabled
move_4 = Move(Geometry=crv_5, Motion=ln_4)  # -> Geometry, Transform
len_3 = Length(Curve=ln_2)  # disabled
lng = ListLength(List=move_4.Geometry)
bnd_3 = Bounds(Numbers=len_2)  # disabled
avr_3 = Average(Input=merge)  # disabled
avr_4 = Average(Input=merge_2)  # disabled
avr_5 = Average(Input=merge_4)  # disabled
avr_6 = Average(Input=merge_3)  # disabled
panel_5 = Panel("10 to 40")  # disabled
panel_6 = Panel(" 3 to 8")  # disabled
bnd_4 = Bounds(Numbers=len_3)  # disabled
dom_2 = ConstructDomain(DomainStart=number_slider_9, DomainEnd=number_slider_10)  # disabled
random = Random(Range=" 0 to 180", Number=lng, Seed=2)
remap_3 = RemapNumbers(Value=len_2, Source=bnd_3, Target=dom_2)  # -> graft(Mapped), Clipped; disabled
remap_4 = RemapNumbers(Value=len_3, Source=bnd_4, Target=panel_6)  # -> graft(Mapped), Clipped; disabled
pt_4 = ConstructPoint(XCoordinate=avr_3, YCoordinate=avr_4, ZCoordinate=remap_4.Mapped)  # -> flatten(Point); disabled
rotate = Rotate(Geometry=move_4.Geometry, Angle=degrees(random), Plane=cull_2)  # -> Geometry, Transform
pt_5 = ConstructPoint(XCoordinate=avr_5, YCoordinate=avr_6, ZCoordinate=remap_3.Mapped)  # -> flatten(Point); disabled
pdecon_8 = Deconstruct(Point=pt_5)  # -> XComponent, YComponent, ZComponent; disabled
arc_2 = Arc3Pt(PointA=pt_2, PointB=pt_4, PointC=pt_3)  # -> Arc, Plane, Radius; disabled
number_slider_11 = Slider(1, range=0..10)  # disabled
panel_7 = Panel("""1
0""")  # disabled
loft_2 = Loft(Curves=arc_2.Arc, Options={Adjust=False, Closed=False, LoftEnds=0, LoftSimp=0, LoftType=0, Rebuild=10, Refit=0.01})  # disabled
dispatch_3 = Dispatch(List=pdecon_8.ZComponent, DispatchPattern=panel_7)  # -> ListA, ListB; disabled
neg_2 = Negative(Value=number_slider_11)  # disabled

# ---- group: opcion 2 - CERCHAS
dispatch_4 = Dispatch(List=arc.Arc, DispatchPattern=[True, False])  # -> ListA, ListB; disabled
dispatch_5 = Dispatch(List=arc.Plane, DispatchPattern=[True, False])  # -> ListA, ListB; disabled
number_slider_12 = Slider(0.6, range=0..10)  # disabled
crv_6 = Curve(dispatch_4.ListA)  # disabled
number_slider_13 = Slider(1, range=0..1)  # disabled
offset = OffsetCurve(Curve=crv_6, Distance=number_slider_12, Plane=dispatch_5.ListA, Corners=1)  # disabled
divdist = DivideDistance(Curve=crv_6, Distance=number_slider_13)  # -> Points, Tangents, Parameters; disabled
pull_5 = PullPoint(Point=divdist.Points, Geometry=offset, ClosestOnly=True)  # -> ClosestPoint, Distance; disabled
panel_8 = Panel("""1
0""")  # disabled
cull_3 = CullPattern(List=divdist.Points, CullPattern=panel_8)  # disabled
cull_4 = CullPattern(List=pull_5.ClosestPoint, CullPattern=invert(panel_8))  # disabled
weave_2 = Weave(Pattern=[0, 1], Stream0=cull_3, Stream1=cull_4, NullGaps=False)  # disabled
pline = PolyLine(Vertices=weave_2, Closed=False)  # disabled
crv_7 = Curve([crv_6, offset])  # disabled

# ----
addition = Addition(A=dispatch_3.ListB, B=neg_2)  # disabled
index = ItemIndex(List=addition, Item=addition)  # disabled
addition_2 = Addition(A=index, B=1)  # disabled
ins = InsertItems(List=dispatch_3.ListA, Item=addition, Indices=addition_2, Wrap=True)  # disabled
pt_6 = ConstructPoint(XCoordinate=pdecon_8.XComponent, YCoordinate=pdecon_8.YComponent, ZCoordinate=ins)  # disabled
number_slider_14 = Slider(16, range=0..30)  # disabled
arc_3 = Arc3Pt(PointA=start_p, PointB=pt_6, PointC=end_p)  # -> Arc, Plane, Radius; disabled
crv_8 = Curve([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])  # disabled
srf_2 = Surface(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)  # disabled
panel_9 = Panel("""1
0""")  # disabled
sdivide_3 = DivideSurface(Surface=srf_2, UCount=number_slider_14, VCount=number_slider_14)  # -> flatten(Points), Normals, Parameters; disabled
cull_5 = CullPattern(List=arc_3.Arc, CullPattern=panel_9)  # disabled
number_slider_15 = Slider(1.7, range=0..10)  # disabled
pull_6 = PullPoint(Point=sdivide_3.Points, Geometry=crv_8, ClosestOnly=True)  # -> ClosestPoint, Distance; disabled
bnd_5 = Bounds(Numbers=pull_6.Distance)  # disabled
number_slider_16 = Slider(24, range=0..100)  # disabled
neg_3 = Negative(Value=number_slider_15)  # disabled
offset_l = OffsetCurveLoose(Curve=cull_5, Distance=number_slider_15)  # disabled
remap_5 = RemapNumbers(Value=pull_6.Distance, Source=bnd_5, Target=Domain(0, 1))  # -> Mapped, Clipped; disabled
graph = GraphMapper(remap_5.Mapped, x0=0, x1=1, y0=0, y1=1, container_name="Bezier", cpx=[0, 0.25, 0.75, 1], cpy=[0, 0.25, 0.75, 1])  # disabled
divide_4 = DivideCurve(Curve=cull_5, Count=number_slider_16, Kinks=False)  # -> Points, Tangents, Parameters; disabled
divide_5 = DivideCurve(Curve=offset_l, Count=number_slider_16, Kinks=False)  # -> Points, Tangents, Parameters; disabled
panel_10 = Panel("0 to 10")  # disabled
panel_11 = Panel("""1
0""")  # disabled
cull_6 = CullPattern(List=divide_5.Points, CullPattern=invert(panel_11))  # disabled
cull_7 = CullPattern(List=divide_4.Points, CullPattern=panel_11)  # disabled
remap_6 = RemapNumbers(Value=graph, Source=Domain(0, 1), Target=panel_10)  # -> Mapped, Clipped; disabled
X = UnitX(Factor=remap_6.Mapped)  # disabled
weave_3 = Weave(Pattern=[0, 1], Stream0=cull_7, Stream1=cull_6, NullGaps=False)  # disabled
move_5 = Move(Geometry=sdivide_3.Points, Motion=X)  # -> Geometry, Transform; disabled
number_slider_17 = Slider(3, range=0..10)  # disabled
number_slider_18 = Slider(3, range=0..10)  # disabled
pline_2 = PolyLine(Vertices=weave_3, Closed=False)  # disabled
srfgrid = SurfaceFromPoints(Points=move_5.Geometry, UCount=expr("x+1", number_slider_14), Interpolate=False)  # disabled
intcrv = Interpolate(Vertices=weave_3, Degree=3, Periodic=False, KnotStyle=1)  # -> Curve, Length, Domain; disabled
loft_3 = Loft(Curves=arc_3.Arc, Options={Adjust=False, Closed=False, LoftEnds=0, LoftSimp=0, LoftType=0, Rebuild=10, Refit=0.01})  # disabled
Z_3 = UnitZ(Factor=1)  # disabled
Y = UnitY(Factor=1)  # disabled
contour = Contour(Shape=srfgrid, Point=Point(0, 0, 0), Direction=Y, Distance=number_slider_17)  # disabled
contour_2 = Contour(Shape=srfgrid, Point=Point(0, 0, 0), Direction=Z_3, Distance=number_slider_18)  # disabled
X_2 = UnitX(Factor=1)  # disabled
X_3 = UnitX(Factor=1)  # disabled
number_slider_19 = Slider(0.4, range=0..1)  # disabled
project = Project(Curve=contour, Brep=srf_2, Direction=X_3)  # disabled
project_2 = Project(Curve=contour_2, Brep=srf_2, Direction=X_2)  # disabled
rulesrf = RuledSurface(CurveA=project, CurveB=contour)  # disabled
rulesrf_2 = RuledSurface(CurveA=contour_2, CurveB=project_2)  # disabled
Y_2 = UnitY(Factor=number_slider_19)  # disabled
Z_4 = UnitZ(Factor=number_slider_19)  # disabled
extr = Extrude(Base=rulesrf, Direction=Y_2)  # disabled
extr_2 = Extrude(Base=rulesrf_2, Direction=Z_4)  # disabled
