# Grasshopper definition sesion 4- elk-ciudad3d- panelizados.gh (Grasshopper 1.0.7)
# Copyright: N.FC.M
# plug-ins: ElkGHComponents

# CLASE
# ELK - CLUSTER
nacho = NACHO()
# CLASE
# panelizados superficies
nacho_2 = NACHO()
# CLASE
# extra
# pilar mediateca
nacho_3 = NACHO()

number_slider = Slider(3, range=0..10)  # disabled
number_slider_2 = Slider(1.3, range=0..10)  # disabled
cir = Circle(Plane=PlaneXY(0, 0, 0), Radius=1)  # disabled
series = Series(Start=0, Step=number_slider_2, Count=number_slider)  # disabled
Z = UnitZ(Factor=series)  # disabled
number_slider_3 = Slider(9, range=0..10)  # disabled
panel = Panel("-0.5 to 0.5")  # disabled
move = Move(Geometry=cir, Motion=Z)  # -> Geometry, Transform; disabled
random = Random(Range=panel, Number=number_slider, Seed=number_slider_3)  # disabled
jitter = Jitter(List=random, Jitter=1, Seed=2)  # -> Values, Indices; disabled
vec = VectorXYZ(XComponent=random, YComponent=jitter.Values, ZComponent=0)  # -> Vector, Length; disabled
move_2 = Move(Geometry=move.Geometry, Motion=vec.Vector)  # -> Geometry, Transform; disabled
panel_2 = Panel("0.6 to 1.2")  # disabled
area = Area(Geometry=move_2.Geometry)  # -> Area, Centroid; disabled
random_2 = Random(Range=panel_2, Number=number_slider, Seed=number_slider_3)  # disabled
scale = Scale(Geometry=move_2.Geometry, Center=area.Centroid, Factor=random_2)  # -> Geometry, Transform; disabled
number_slider_4 = Slider(9, range=0..100)  # disabled
lng = ListLength(List=scale.Geometry)  # disabled
lng_2 = ListLength(List=scale.Geometry)  # disabled
panel_3 = Panel("-1")  # disabled
series_2 = Series(Start=0, Step=1, Count=lng)  # -> graft(Series); disabled
series_3 = Series(Start=0, Step=panel_3, Count=lng_2)  # -> graft(Series); disabled
divide = DivideCurve(Curve=scale.Geometry, Count=number_slider_4, Kinks=False)  # -> Points, Tangents, Parameters; disabled
shift = ShiftList(List=divide.Points, Shift=series_2, Wrap=True)  # disabled
shift_2 = ShiftList(List=divide.Points, Shift=series_3, Wrap=True)  # disabled
flip = FlipMatrix(Data=shift)  # disabled
flip_2 = FlipMatrix(Data=shift_2)  # disabled
pline = PolyLine(Vertices=flip_2, Closed=False)  # disabled
pline_2 = PolyLine(Vertices=flip, Closed=False)  # disabled
crv = Curve(flatten([scale.Geometry, pline_2, pline]))  # disabled
number_slider_5 = Slider(0.04, range=0..0.1)  # disabled
pipe = Pipe(Curve=crv, Radius=number_slider_5, Caps=0)  # disabled

# ----
# SESION  - 4 -
# GRASHOPPER BASICO {1}
# Nacho Monereo.
# nachomonereo@gmail.com
nacho_4 = NACHO()

# ----
# REF-SUP
number_slider_6 = Slider(10, range=0..10)  # disabled
number_slider_7 = Slider(10, range=0..10)  # disabled
rectangle = Rectangle(
    Plane=Plane(origin=(29.48039402, 24.48486291, 0), x=(0.820982794, -0.5709529333, 0), y=(0.5709529333, 0.820982794, 0)),
    XSize=number_slider_6,
    YSize=number_slider_7,
    Radius=0)  # -> Rectangle, Length; disabled
number_slider_8 = Slider(9, range=0..100)  # disabled
srf = Surface(reparameterize(rectangle.Rectangle))  # disabled
crv_2 = Curve([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])  # disabled
sdivide = DivideSurface(Surface=srf, UCount=number_slider_8, VCount=number_slider_8)  # -> flatten(Points), Normals, Parameters; disabled
pull = PullPoint(Point=sdivide.Points, Geometry=crv_2, ClosestOnly=True)  # -> ClosestPoint, Distance; disabled
panel_4 = Panel("4 to 0")  # disabled
bnd = Bounds(Numbers=pull.Distance)  # disabled
remap = RemapNumbers(Value=pull.Distance, Source=bnd, Target=panel_4)  # -> Mapped, Clipped; disabled
Z_2 = UnitZ(Factor=remap.Mapped)  # disabled
move_3 = Move(Geometry=sdivide.Points, Motion=Z_2)  # -> Geometry, Transform; disabled
srfgrid = SurfaceFromPoints(Points=move_3.Geometry, UCount=expr("x+1", number_slider_8), Interpolate=False)  # disabled

make_nacho = Makenacho()  # disabled

path = FilePath("A:\00-ORDENADOR-GDRIVE\CURSOS GH\Curso gh  {1} 15-19 JUNIO 2020\dia2-mapa.osm")  # disabled
loc = Location(FilePathText=path)  # -> OSMPointData, OSMFile, LongitudeDomain, LatitudeDomain; disabled
osm = OSMData(OSMPointData=loc.OSMPointData, OSMFilePath=loc.OSMFile, Feature="building", Generate3d=False, IndividualOutputs=False)  # -> Ways, FeatureKey; disabled
pline_3 = PolyLine(Vertices=osm.Ways, Closed=True)  # disabled
path_mapper = PathMapper(pline_3, source="{A;B}", target="{A}")  # disabled
boundary = BoundarySurfaces(Edges=path_mapper)  # -> flatten(Surfaces); disabled
crv_3 = Curve(path_mapper)  # disabled
panel_5 = Panel(" 15 to 25")  # disabled
lng_3 = ListLength(List=boundary)  # disabled
random_3 = Random(Range=panel_5, Number=lng_3, Seed=2)  # disabled
Z_3 = UnitZ(Factor=random_3)  # disabled
extr = Extrude(Base=boundary, Direction=Z_3)  # disabled
crv_4 = Curve(crv_3)  # disabled
brep = Brep(extr)  # disabled

number_slider_9 = Slider(60, range=0..100)  # disabled
pop3d = Populate3D(
    Region={Plane=PlaneXY(22.18871309, 0, 0), X=Domain(0, 10.05991483), Y=Domain(0, 10.05991483), Z=Domain(0, 9.816868963)},
    Count=number_slider_9,
    Seed=1)  # disabled
number_slider_10 = Slider(42, range=0..100)  # disabled
voronoi³ = Voronoi3D(Points=pop3d)  # -> Cells, Boundary; disabled
number_slider_11 = Slider(100, range=0..100)  # disabled
reduce = RandomReduce(List=voronoi³.Cells, Reduction=number_slider_10, Seed=number_slider_11)  # disabled

number_slider_12 = Slider(1.6, range=0..10)  # disabled
srf_2 = Surface(srfgrid)  # disabled
dim = Dimensions(Surface=srf_2)  # -> UDimension, VDimension; disabled
division = Division(A=dim.VDimension, B=number_slider_12)  # disabled
division_2 = Division(A=dim.UDimension, B=number_slider_12)  # disabled
divide_2 = DivideDomain²(Domain=srf_2, UCount=division_2, VCount=division)  # disabled
number_slider_13 = Slider(4, range=0..10)  # disabled
brep_2 = Brep(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)  # disabled
sbox = SurfaceBox(Surface=srf_2, Domain=divide_2, Height=number_slider_13)  # disabled
box = Box(brep_2)  # disabled
morph = BoxMorph(Geometry=brep_2, Reference=box, Target=sbox)  # disabled

bg = Cluster(R=Domain(0, 1))  # -> crv_2, E, K

srf_3 = Surface(srfgrid)  # disabled
dim_2 = Dimensions(Surface=srf_3)  # -> UDimension, VDimension; disabled
expression = Expression(x=dim_2.VDimension, Expression="sqrt(x²-(x/2)²)")  # disabled
trigrid = Triangular(Plane=PlaneXY(0, 0, 0), Size=1, ExtentX=dim_2.UDimension, ExtentY=expression)  # -> flatten(Cells), Points; disabled
bbox = BoundingBox(Content=trigrid.Cells, Plane=PlaneXY(0, 0, 0), UnionBox=True)  # -> Box, Box_2; disabled
map_srf = MapToSurface(Curve=trigrid.Cells, Source=bbox.Box, Target=srf_3)  # disabled
explode = Explode(Curve=map_srf, Recursive=True)  # -> Segments, Vertices; disabled
srf_4 = Surface(map_srf)  # disabled
panel_6 = Panel("0")  # disabled
cull_i = CullIndex(List=explode.Vertices, Indices=panel_6, Wrap=True)  # disabled
number_slider_14 = Slider(2, range=0..10)  # disabled
nurbs = NurbsCurve(Vertices=cull_i, Degree=number_slider_14, Periodic=True)  # -> Curve, Length, Domain; disabled

srf_5 = Surface(srfgrid)  # disabled
dim_3 = Dimensions(Surface=srf_5)  # -> UDimension, VDimension; disabled
rectangle_2 = Rectangle(Plane=PlaneXY(0, 0, 0), XSize=dim_3.UDimension, YSize=dim_3.VDimension, Radius=0)  # -> Rectangle, Length; disabled
number_slider_15 = Slider(28, range=0..100)  # disabled
srf_6 = Surface(reparameterize(rectangle_2.Rectangle))  # disabled
boundary_2 = BoundarySurfaces(Edges=rectangle_2.Rectangle)  # -> reparameterize(Surfaces); disabled
division_3 = Division(A=dim_3.UDimension, B=number_slider_15)  # disabled
number_slider_16 = Slider(0.1, range=0..0.1)  # disabled
sdivide_2 = DivideSurface(Surface=boundary_2, UCount=number_slider_15, VCount=number_slider_15)  # -> flatten(Points), Normals, flatten(Parameters); disabled
image = ImageSampler(sdivide_2.Parameters, Filter="Value", Interpolate=False, Umax=1, Umin=0, Vmax=1, Vmin=0, Wrap=1)  # disabled
bnd_2 = Bounds(Numbers=image)  # disabled
dom = ConstructDomain(DomainStart=number_slider_16, DomainEnd=expr("x/2", division_3))  # disabled
dom_2 = ConstructDomain(DomainStart=expr("x/2", division_3), DomainEnd=number_slider_16)  # disabled
remap_2 = RemapNumbers(Value=image, Source=bnd_2, Target=dom)  # -> Mapped, Clipped; disabled
cir_2 = Circle(Plane=sdivide_2.Points, Radius=remap_2.Mapped)  # disabled
bbox_2 = BoundingBox(Content=cir_2, Plane=PlaneXY(0, 0, 0), UnionBox=True)  # -> Box, Box_2; disabled
srf_7 = Surface(srfgrid)  # disabled
map_srf_2 = MapToSurface(Curve=cir_2, Source=bbox_2.Box, Target=srf_7)  # disabled

srf_8 = Surface(srfgrid)  # disabled
dim_4 = Dimensions(Surface=srf_8)  # -> UDimension, VDimension; disabled
expression_2 = Expression(x=dim_4.VDimension, Expression="sqrt(x²-(x/2)²)")  # disabled
hexgrid = Hexagonal(Plane=PlaneXY(0, 0, 0), Size=1, ExtentX=dim_4.UDimension, ExtentY=expression_2)  # -> flatten(Cells), Points; disabled
bbox_3 = BoundingBox(Content=hexgrid.Cells, Plane=PlaneXY(0, 0, 0), UnionBox=True)  # -> Box, Box_2; disabled
map_srf_3 = MapToSurface(Curve=hexgrid.Cells, Source=bbox_3.Box, Target=srf_8)  # disabled
explode_2 = Explode(Curve=map_srf_3, Recursive=True)  # -> Segments, Vertices; disabled
panel_7 = Panel("0")  # disabled
cull_i_2 = CullIndex(List=explode_2.Vertices, Indices=panel_7, Wrap=True)  # disabled
number_slider_17 = Slider(2, range=0..10)  # disabled
nurbs_2 = NurbsCurve(Vertices=cull_i_2, Degree=number_slider_17, Periodic=True)  # -> Curve, Length, Domain; disabled

srf_9 = Surface(reparameterize(srfgrid))  # disabled
# panelizado voronoi
dim_5 = Dimensions(Surface=srf_9)  # -> UDimension, VDimension; disabled
rectangle_3 = Rectangle(Plane=PlaneXY(0, 0, 0), XSize=dim_5.UDimension, YSize=dim_5.VDimension, Radius=0)  # -> Rectangle, Length; disabled
number_slider_18 = Slider(33, range=0..100)  # disabled
number_slider_19 = Slider(50, range=0..100)  # disabled
pop2d = Populate2D(Region=rectangle_3.Rectangle, Count=number_slider_19, Seed=number_slider_18)  # disabled
number_slider_20 = Slider(0.9, range=0..1)  # disabled
voronoi = Voronoi(Points=pop2d, Boundary=rectangle_3.Rectangle, BruteForceOverride=False)  # disabled
area_2 = Area(Geometry=voronoi)  # -> Area, Centroid; disabled
scale_2 = Scale(Geometry=voronoi, Center=area_2.Centroid, Factor=number_slider_20)  # -> Geometry, Transform; disabled
rdiff = RegionDifference(CurvesA=rectangle_3.Rectangle, CurvesB=scale_2.Geometry)  # disabled
boundary_3 = BoundarySurfaces(Edges=rdiff)  # disabled
Z_4 = UnitZ(Factor=1)  # disabled
extr_2 = Extrude(Base=boundary_3, Direction=Z_4)  # disabled
panel_8 = Panel("0 to 1")  # disabled
panel_9 = Panel("0 to 0.2")  # disabled
box_2 = Box(extr_2)  # disabled
srfmorph = SurfaceMorph(Geometry=extr_2, Reference=box_2, Surface=srf_9, UDomain=panel_8, VDomain=panel_8, WDomain=panel_9)  # disabled

panel_10 = Panel(" 10 to 25")  # disabled
path_2 = FilePath("A:\00-ORDENADOR-GDRIVE\CURSOS GH\Curso gh  {1} 15-19 JUNIO 2020\dia2-mapa.osm")  # disabled
cluster = Cluster(file=path_2, R=panel_10)  # -> crv_2, E, K; disabled
# SET
panel_11 = Panel("0 to 10")
brep_3 = Brep(cluster.E)  # disabled
crv_5 = Curve(cluster.crv_2)  # disabled
crv_6 = Curve(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)
random_4 = Random(Range=panel_11, Number=Slider(10, range=0..10), Seed=2)
series_4 = Series(Start=0, Step=Slider(0.5, range=0..1), Count=Slider(30, range=0..100))
panel_12 = Panel("""2
5
6
7
8
34
23
46
46
2""")
panel_13 = Panel(random_4)
fsim = FindSimilarMember(Data=random_4, Set=series_4)  # -> Hit, Index
cset = CreateSet(List=panel_12)  # -> Set, Map
escalera = ESCALERA(
    altura_libre=Slider(5, range=0..10),
    conta_huella=Slider(0.17, range=0..1),
    crv=crv_6,
    tipe=Slider(1, range=0..10),
    offset=Slider(2, range=0..10))  # -> B, B_2
stair = Escalera_2(crv=<geometry referenced from the Rhino model>, C=1)
mindex = MemberIndex(Set=fsim.Hit, Member=cset.Set)  # -> Index, Count
panel_14 = Panel(cset.Set)
# https://www.food4rhino.com/en/app/lunchbox
# 
# https://www.food4rhino.com/en/app/elk
# 
# https://www.food4rhino.com/en/app/pufferfish?lang=en
# 
# https://www.food4rhino.com/en/app/opennest
# 
# https://www.food4rhino.com/en/app/heteroptera
# 
# https://www.food4rhino.com/en/app/ladybug-tools
# 
# https://www.food4rhino.com/en/app/ivy
# 
# https://www.food4rhino.com/en/app/anemone **
# 
# https://www.food4rhino.com/en/app/human
# 
# https://www.grasshopper3d.com/profiles/blogs/meshmachine-update
# 
# https://www.grasshopper3d.com/group/plankton
# 
# https://www.bespokegeometry.com/2015/07/22/cocoon/
# 
# https://toolbox.decodingspaces.net/
panel_15 = Panel(fsim.Hit)
path_3 = FilePath("C:\Users\test\Downloads\map (1).osm")  # disabled
path_4 = FilePath()  # disabled
loc_2 = Location(FilePText=path_3)  # -> OSMPointData, OSMData, LongitudeDomain, LatitudeDomain; disabled
loc_3 = Location(FilePathText=path_3)  # -> OSMPointData, OSMData, LongitudeDomain, LatitudeDomain; disabled
panel_16 = Panel("building")  # disabled
osm_2 = OSMData(
    OSMPointData=loc_3.OSMPointData,
    OSMDataText=loc_3.OSMData,
    Feature="building",
    Generate3d=False,
    IndividualOutputs=False)  # -> Ways, FeatureKey; disabled
genosm = GenericOSM(OSMPointData=loc_2.OSMPointData, OSMDataText=loc_2.OSMData, FeatureKey=panel_16, FeatureValue="*", CollectionType=0)  # -> FeaturePoints, FeatureKey; disabled
osm_3 = OSMData(OSMPointData=loc_3.OSMPointData, OSMDataText=loc_3.OSMData, Feature="tourism", Generate3d=False, IndividualOutputs=False)  # -> Ways, FeatureKey; disabled
number_slider_21 = Slider(20, range=0..100)  # disabled
toggle = BooleanToggle(True)  # disabled
toggle_2 = BooleanToggle(False)  # disabled
pline_4 = PolyLine(Vertices=osm_2.Ways, Closed=toggle)  # disabled
number_slider_22 = Slider(6, range=0..100)  # disabled
pline_5 = PolyLine(Vertices=osm_3.Ways, Closed=toggle_2)  # disabled
rectangle_4 = Rectangle(Plane=PlaneXY(0, 0, 0), XSize=number_slider_21, YSize=number_slider_21, Radius=0)  # -> Rectangle, Length; disabled
number_slider_23 = Slider(5, range=0..100)  # disabled
path_mapper_2 = PathMapper(pline_4, source="{A;B}", target="{A}")  # disabled
path_mapper_3 = PathMapper(pline_4, source="{A;B}", target="{A}")  # disabled
srf_10 = Surface(rectangle_4.Rectangle)  # disabled
number_slider_24 = Slider(3.3, range=0..10)  # disabled
boundary_4 = BoundarySurfaces(Edges=path_mapper_2)  # -> flatten(Surfaces); disabled
lng_4 = ListLength(List=boundary_4)  # disabled
sdivide_3 = DivideSurface(Surface=srf_10, UCount=number_slider_23, VCount=number_slider_23)  # -> flatten(Points), Normals, Parameters; disabled
panel_17 = Panel(" 20 to 35")  # disabled
brep_4 = Brep(<brep referenced from the Rhino model>)  # disabled
neg = Negative(Value=number_slider_24)  # disabled
random_5 = Random(Range=panel_17, Number=lng_4, Seed=2)  # disabled
box_3 = Box(brep_4)  # disabled
crv_7 = Curve([<curve referenced from the Rhino model> x80])  # disabled
lng_5 = ListLength(List=sdivide_3.Points)  # disabled
panel_18 = Panel(" 0 to 10")  # disabled
bbox_4 = BoundingBox(Content=crv_7, Plane=PlaneXY(0, 0, 0), UnionBox=True)  # -> Box, Box_2; disabled
number_slider_25 = Slider(3, range=0..10)  # disabled
Z_5 = UnitZ(Factor=random_5)  # disabled
extr_3 = Extrude(Base=boundary_4, Direction=Z_5)  # disabled
random_6 = Random(Range=panel_18, Number=lng_5, Seed=number_slider_25)  # disabled
Z_6 = UnitZ(Factor=random_6)  # disabled
move_4 = Move(Geometry=sdivide_3.Points, Motion=Z_6)  # -> Geometry, Transform; disabled
panel_19 = Panel("0")  # disabled
srfgrid_2 = SurfaceFromPoints(Points=move_4.Geometry, UCount=expr("x+1", number_slider_23), Interpolate=False)  # disabled
srf_base = Surface(reparameterize(srfgrid_2))  # disabled
srf_base_2 = Surface(srfgrid_2)  # disabled
dim_6 = Dimensions(Surface=srf_base_2)  # -> UDimension, VDimension; disabled
srf_base_3 = Surface(srfgrid_2)  # disabled
dim_7 = Dimensions(Surface=srf_base_3)  # -> UDimension, VDimension; disabled
divide_3 = DivideDomain²(Domain=srf_base, UCount=number_slider_22, VCount=number_slider_22)  # disabled
expression_3 = Expression(x=dim_6.VDimension, Expression="sqrt(x²-(x/2)²)")  # disabled
expression_4 = Expression(x=dim_7.VDimension, Expression="sqrt(x²-(x/2)²)")  # disabled
sbox_2 = SurfaceBox(Surface=srf_base, Domain=divide_3, Height=number_slider_24)  # disabled
trigrid_2 = Triangular(Plane=PlaneXY(0, 0, 0), Size=1, ExtentX=dim_7.UDimension, ExtentY=expression_4)  # -> flatten(Cells), Points; disabled
hexgrid_2 = Hexagonal(Plane=PlaneXY(0, 0, 0), Size=1, ExtentX=dim_6.UDimension, ExtentY=expression_3)  # -> flatten(Cells), Points; disabled
srf_base_4 = Surface(srfgrid_2)  # disabled
bbox_5 = BoundingBox(Content=hexgrid_2.Cells, Plane=PlaneXY(0, 0, 0), UnionBox=True)  # -> Box, Box_2; disabled
bbox_6 = BoundingBox(Content=trigrid_2.Cells, Plane=PlaneXY(0, 0, 0), UnionBox=True)  # -> Box, Box_2; disabled
morph_2 = BoxMorph(Geometry=brep_4, Reference=box_3, Target=sbox_2)  # disabled
map_srf_4 = MapToSurface(Curve=hexgrid_2.Cells, Source=bbox_5.Box, Target=srf_base_2)  # disabled
map_srf_5 = MapToSurface(Curve=trigrid_2.Cells, Source=bbox_6.Box, Target=srf_base_3)  # disabled
map_srf_6 = MapToSurface(Curve=crv_7, Source=bbox_4.Box, Target=srf_base_4)  # disabled
explode_3 = Explode(Curve=map_srf_4, Recursive=True)  # -> Segments, Vertices; disabled
cull_i_3 = CullIndex(List=explode_3.Vertices, Indices=panel_19, Wrap=True)  # disabled
toggle_3 = BooleanToggle(True)  # disabled
panel_20 = Panel("2")  # disabled
number_slider_26 = Slider(30, range=0..100)  # disabled
nurbs_3 = NurbsCurve(Vertices=cull_i_3, Degree=panel_20, Periodic=toggle_3)  # -> Curve, Length, Domain; disabled
number_slider_27 = Slider(7, range=0..10)  # disabled
rectangle_5 = Rectangle(Plane=PlaneXY(0, 0, 0), XSize=number_slider_26, YSize=number_slider_26, Radius=0)  # -> Rectangle, Length; disabled
number_slider_28 = Slider(9.3, range=0..10)  # disabled
number_slider_29 = Slider(1.4, range=0..10)  # disabled
number_slider_30 = Slider(4, range=0..10)  # disabled
srf_11 = Surface(rectangle_5.Rectangle)  # disabled
number_slider_31 = Slider(3, range=2..15)  # disabled
sdivide_4 = DivideSurface(Surface=srf_11, UCount=number_slider_30, VCount=number_slider_30)  # -> flatten(Points), Normals, Parameters; disabled
brep_5 = Brep(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)  # disabled
brep_6 = Brep(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)  # disabled
panel_21 = Panel("0 to 10")  # disabled
lng_6 = ListLength(List=sdivide_4.Points)  # disabled
box_4 = Box(brep_5)  # disabled
brep_7 = Brep(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)  # disabled
random_7 = Random(Range=panel_21, Number=lng_6, Seed=2)  # disabled
Z_7 = UnitZ(Factor=random_7)  # disabled
crv_8 = Curve([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])  # disabled
move_5 = Move(Geometry=sdivide_4.Points, Motion=Z_7)  # -> Geometry, Transform; disabled
panel_22 = Panel("1")  # disabled
addition = Addition(A=number_slider_30, B=panel_22)  # disabled
bbox_7 = BoundingBox(Content=crv_8, Plane=PlaneXY(0, 0, 0), UnionBox=True)  # -> Box, Box_2; disabled
srfgrid_3 = SurfaceFromPoints(Points=move_5.Geometry, UCount=addition, Interpolate=False)  # disabled
srf_12 = Surface(srfgrid_3)  # disabled
srf_13 = Surface(srfgrid_3)  # disabled
dim_8 = Dimensions(Surface=srf_13)  # -> UDimension, VDimension; disabled
divide_4 = DivideDomain²(Domain=srf_12, UCount=number_slider_27, VCount=number_slider_27)  # disabled
expression_5 = Expression(a=dim_8.VDimension, Expression="sqrt(a²-(a²/2))")  # disabled
sbox_3 = SurfaceBox(Surface=srf_12, Domain=divide_4, Height=[number_slider_28, number_slider_29])  # disabled
division_4 = Division(A=dim_8.UDimension, B=number_slider_31)  # disabled
division_5 = Division(A=expression_5, B=number_slider_31)  # disabled
morph_3 = BoxMorph(Geometry=brep_5, Reference=box_4, Target=sbox_3)  # disabled
trigrid_3 = Triangular(Plane=PlaneXY(0, 0, 0), Size=1, ExtentX=division_4, ExtentY=division_5)  # -> flatten(Cells), Points; disabled
morph_4 = BoxMorph(Geometry=brep_6, Reference=brep_7, Target=sbox_3)  # disabled
bbox_8 = BoundingBox(Content=trigrid_3.Cells, Plane=PlaneXY(0, 0, 0), UnionBox=True)  # -> Box, Box_2; disabled
crv_9 = Curve(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)  # disabled
map_srf_7 = MapToSurface(Curve=trigrid_3.Cells, Source=bbox_8.Box, Target=srf_13)  # disabled
map_srf_8 = MapToSurface(Curve=crv_8, Source=bbox_7.Box, Target=srf_13)  # disabled
geo = Geometry(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)  # disabled
flip_3 = FlipCurve(Curve=crv_9)  # -> Curve, Flag; disabled
trimap = TriangleMapping(Geometry=geo, Source=flip_3.Curve, Target=map_srf_7)  # -> Geometry, Transform; disabled

# ==== cluster Cluster
file = ClusterInput()
loc = Location(FilePathText=file)  # -> OSMPointData, OSMFile, LongitudeDomain, LatitudeDomain
osm = OSMData(OSMPointData=loc.OSMPointData, OSMFilePath=loc.OSMFile, Feature="building", Generate3d=False, IndividualOutputs=False)  # -> Ways, FeatureKey
pline = PolyLine(Vertices=osm.Ways, Closed=True)
path_mapper = PathMapper(pline, source="{A;B}", target="{A}")
boundary = BoundarySurfaces(Edges=path_mapper)  # -> flatten(Surfaces)
K = ClusterOutput(osm.FeatureKey)
crv = Curve(path_mapper)
R = ClusterInput()
lng = ListLength(List=boundary)
crv_2 = ClusterOutput(crv)
random = Random(Range=R, Number=lng, Seed=2)
Z = UnitZ(Factor=random)
extr = Extrude(Base=boundary, Direction=Z)
E = ClusterOutput(extr)

# ==== cluster Makenacho
polygon = Polygon(Plane=PlaneXY(0, 0, 0), Radius=3, Segments=3, FilletRadius=0.2)  # -> Polygon, Length
rotate = Rotate(Geometry=polygon.Polygon, Angle=1.570796327, Plane=PlaneXY(0, 0, 0))  # -> Geometry, Transform
curvepoint = PointOnCurve(rotate.Geometry, parameter=0.479)
boundary = BoundarySurfaces(Edges=rotate.Geometry)
popgeo = PopulateGeometry(Geometry=boundary, Count=100, Seed=1)
scale = Scale(Geometry=popgeo, Center=Point(0, 0, 0), Factor=0.98)  # -> Geometry, Transform
cir = Circle(Plane=scale.Geometry, Radius=0.04)
preview = CustomPreview(
    Geometry=[boundary, cir],
    Material={diffuse=RGB(225, 131, 15), emission=RGB(68, 39, 4), shine=0, specular=RGB(255, 255, 255), transparency=0.3333333333})
tag = TextTag3D(Location=curvepoint, Text="NFCM", Size=0.5, Colour=RGBA(130, 120, 81, 215), Justification=2)

# ==== cluster ESCALERA
crv = ClusterInput()
altura_libre = ClusterInput()
crv_2 = Curve(crv)
altura_libre_2 = Number(altura_libre)
conta_huella = ClusterInput()
fillet = Fillet(Curve=crv_2, Radius=Slider(0.3, range=0..1))
tipe = ClusterInput()
offset = ClusterInput()
merge = Merge(Data1=crv_2, Data2=fillet)  # -> flatten(Result)
division = Division(A=altura_libre_2, ContaHuella=conta_huella)
tipe_2 = Number(tipe)
offset_2 = Number(offset)
neg = Negative(Value=offset_2)
item = ListItem(List=merge, Index=expr("x-1", tipe_2), Wrap=True)
round = Round(Number=division)  # -> Nearest, Floor, Ceiling
division_2 = Division(A=altura_libre_2, B=round.Nearest)
divide = DivideCurve(Curve=item, Count=round.Nearest, Kinks=False)  # -> Points, Tangents, Parameters
offset_3 = OffsetCurve(Curve=item, Distance=neg, Plane=PlaneXY(0, 0, 0), Corners=tipe_2)
loft = Loft(
    Curves=flatten([offset_3, item]),
    Options={Adjust=False, Closed=False, LoftEnds=0, LoftSimp=0, LoftType=0, Rebuild=10, Refit=0.01})
pull = PullPoint(Point=divide.Points, Geometry=offset_3, ClosestOnly=True)  # -> ClosestPoint, Distance
series = Series(Start=division_2, Step=division_2, Count=round.Nearest)
ln = Line(StartPoint=divide.Points, EndPoint=pull.ClosestPoint)
Z = UnitZ(Factor=series)
srfsplit = SurfaceSplit(Surface=loft, Curves=ln)
area = Area(Geometry=srfsplit)  # -> Area, Centroid
crv_cp = CurveClosestPoint(Point=area.Centroid, Curve=item)  # -> Point, Parameter, Distance
sort = SortList(Keys=crv_cp.Parameter, ValuesA=srfsplit)  # -> Keys, ValuesA
move = Move(Geometry=ln, Motion=Z)  # -> Geometry, Transform
lng = ListLength(List=move.Geometry)
move_2 = Move(Geometry=sort.ValuesA, Motion=Z)  # -> Geometry, Transform
subtraction = Subtraction(A=lng, B=1)
cull_i = CullIndex(List=move.Geometry, Indices=flatten(subtraction), Wrap=True)
neg_2 = Negative(Value=division_2)
Z_2 = UnitZ(Factor=neg_2)
extr = Extrude(Base=cull_i, Direction=Z_2)
join = BrepJoin(Breps=[move_2.Geometry, extr])  # -> Breps, Closed
B = ClusterOutput(join.Breps)
edges = BrepEdges(Brep=join.Breps)  # -> Naked, Interior, NonManifold
len = Length(Curve=edges.Naked)
similar = Similarity(FirstNumber=len, SecondNumber=offset_2, Threshold=0.1)  # -> Similarity, AbsoluteDifference
cull = CullPattern(List=edges.Naked, CullPattern=invert(similar.Similarity))
join_2 = JoinCurves(Curves=cull, Preserve=False)
topoly = CurveToPolyline(Curve=join_2, ToleranceDistance=0, ToleranceAngle=degrees(Slider(9, range=0..100)))  # -> Polyline, Segments
redpline = Reduce(Polyline=topoly.Polyline, Tolerance=Slider(0.21, range=0..1))  # -> simplify(graft(Polyline)), Reduction
smoothpline = SmoothPolyline(Polyline=topoly.Polyline, Strength=1, Times=Slider(2, range=0..10))  # -> simplify(graft(Polyline))
merge_2 = Merge(Data1=redpline.Polyline, Data2=smoothpline)
flip = FlipMatrix(Data=merge_2)
tstat = TreeStatistics(Tree=flip)  # -> Paths, Length, Count
item_2 = ListItem(List=tstat.Paths, Index=expr("x-1", tipe_2), Wrap=True)
branch = TreeBranch(Tree=flip, Path=item_2, MaintainPaths=True)
B_2 = ClusterOutput(branch)

# ==== cluster Escalera_2
num = ClusterInput()
num_2 = Number(num)
crv = ClusterInput()
ch = ClusterInput()
crv_2 = Curve(crv)
expression = Expression(altura_libre=num_2, ch=ch, Expression="altura_libre/ch")
explode = Explode(Curve=crv_2, Recursive=True)  # -> Segments, Vertices
round = Round(Number=expression)  # -> Nearest, Floor, Ceiling
n_escalones = Panel(round.Nearest)
len = Length(Curve=explode.Segments)
len_2 = Length(Curve=crv_2)
expression_2 = Expression(altura_libre=num_2, n_escalones=round.Nearest, Expression="altura_libre/n_escalones")
expression_3 = Expression(long_seg=len, n_escalones=n_escalones, longitud_total=len_2, Expression="(long_seg*n_escalones)/longitud_total")
panel = Panel(expression_2)
expression_4 = Expression(ch_real=panel, Expression="0.63-(2*ch_real)")
huella = Panel(expression_4)
crv_3 = Curve(explode.Segments)
round_2 = Round(Number=expression_3)  # -> Nearest, Floor, Ceiling
divdist = DivideDistance(Curve=crv_3, Distance=huella)  # -> Points, Tangents, Parameters
huella_2 = Panel(expression_4)
number_slider = Slider(2, range=0..10)
division = Division(A=round_2.Nearest, B=number_slider)
lng = ListLength(List=divdist.Points)
division_2 = Division(A=lng, B=number_slider)  # -> flatten(Result)
addition = Addition(A=division_2, B=division)
subtraction = Subtraction(A=division_2, B=division)
round_3 = Round(Number=subtraction)  # -> Nearest, Floor, Ceiling
round_4 = Round(Number=addition)  # -> Nearest, Floor, Ceiling
dom = ConstructDomain(DomainStart=round_3.Nearest, DomainEnd=round_4.Nearest)  # -> graft(Domain)
subset = SubList(List=divdist.Points, Domain=graft(dom), Wrap=True)  # -> List, Index
panel_2 = Panel(dom)
cull_i = CullIndex(List=subset.List, Indices=Slider(0, range=0..100), Wrap=True)
crv_4 = Curve(crv_2)
C = ClusterInput()
x = ClusterInput()
neg = Negative(Value=x)
offset = OffsetCurve(Curve=crv_4, Distance=neg, Plane=PlaneXY(0, 0, 0), Corners=C)
pull = PullPoint(Point=cull_i, Geometry=offset, ClosestOnly=True)  # -> ClosestPoint, Distance
ln = Line(StartPoint=cull_i, EndPoint=pull.ClosestPoint)
Z = UnitZ(Factor=Slider(1.5, range=0..10))
extr = Extrude(Base=ln, Direction=Z)
neg_2 = Negative(Value=Z)
division_3 = Division(A=neg_2, B=Slider(2, range=0..10))
rulesrf = RuledSurface(CurveA=crv_4, CurveB=offset)
move = Move(Geometry=extr, Motion=division_3)  # -> Geometry, Transform
crv_5 = Curve(flatten(ln))
splitmul = SplitBrepMultiple(Brep=rulesrf, Cutters=flatten(move.Geometry))
cull_i_2 = CullIndex(List=splitmul, Indices=Slider(0, range=0..100), Wrap=True)
ch_real = Panel(expression_2)
lng_2 = ListLength(List=cull_i_2)
series = Series(Start=ch_real, Step=ch_real, Count=lng_2)
Z_2 = UnitZ(Factor=ch_real)
Z_3 = UnitZ(Factor=series)
move_2 = Move(Geometry=crv_5, Motion=Z_3)  # -> Geometry, Transform
neg_3 = Negative(Value=Z_2)
move_3 = Move(Geometry=cull_i_2, Motion=Z_3)  # -> Geometry, Transform
extr_2 = Extrude(Base=move_2.Geometry, Direction=neg_3)
join = BrepJoin(Breps=[extr_2, move_3.Geometry])  # -> Breps, Closed
B = ClusterOutput(join.Breps)
