# Grasshopper definition sesion-5-escamas.gh (Grasshopper 1.0.7)
# Copyright: N.FC.M
# plug-ins: Bifocals, Kangaroo2 Components

number_slider = Slider(60, range=0..100)  # disabled
pop3d = Populate3D(
    Region={Plane=PlaneXY(22.18871309, 0, 0), X=Domain(0, 10.05991483), Y=Domain(0, 10.05991483), Z=Domain(0, 9.816868963)},
    Count=number_slider,
    Seed=1)  # disabled
number_slider_2 = Slider(42, range=0..100)  # disabled
voronoi³ = Voronoi3D(Points=pop3d)  # -> Cells, Boundary; disabled
number_slider_3 = Slider(100, range=0..100)  # disabled
reduce = RandomReduce(List=voronoi³.Cells, Reduction=number_slider_2, Seed=number_slider_3)  # disabled

# ----
# SUPERFICIES + PANELIZADO
# REF-SUP
number_slider_4 = Slider(10, range=0..10)  # disabled
number_slider_5 = Slider(10, range=0..10)  # disabled
rectangle = Rectangle(
    Plane=Plane(origin=(29.48039402, 24.48486291, 0), x=(0.820982794, -0.5709529333, 0), y=(0.5709529333, 0.820982794, 0)),
    XSize=number_slider_4,
    YSize=number_slider_5,
    Radius=0)  # -> Rectangle, Length; disabled
number_slider_6 = Slider(5, range=0..100)  # disabled
srf = Surface(reparameterize(rectangle.Rectangle))  # disabled
crv = Curve([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])  # disabled
sdivide = DivideSurface(Surface=srf, UCount=number_slider_6, VCount=number_slider_6)  # -> flatten(Points), Normals, Parameters; disabled
pull = PullPoint(Point=sdivide.Points, Geometry=crv, ClosestOnly=True)  # -> ClosestPoint, Distance; disabled
panel = Panel("4 to 0")  # disabled
bnd = Bounds(Numbers=pull.Distance)  # disabled
remap = RemapNumbers(Value=pull.Distance, Source=bnd, Target=panel)  # -> Mapped, Clipped; disabled
Z = UnitZ(Factor=remap.Mapped)  # disabled
move = Move(Geometry=sdivide.Points, Motion=Z)  # -> Geometry, Transform; disabled
srfgrid = SurfaceFromPoints(Points=move.Geometry, UCount=expr("x+1", number_slider_6), Interpolate=False)  # disabled

# ----
# SESION  - 6 -
# GRASHOPPER BASICO {1}
# Nacho Monereo.
# nachomonereo@gmail.com
# CLASE
nacho = NACHO()

number_slider_7 = Slider(1.6, range=0..10)  # disabled
srf_2 = Surface(srfgrid)  # disabled
dim = Dimensions(Surface=srf_2)  # -> UDimension, VDimension; disabled
division = Division(A=dim.VDimension, B=number_slider_7)  # disabled
division_2 = Division(A=dim.UDimension, B=number_slider_7)  # disabled
divide = DivideDomain²(Domain=srf_2, UCount=division_2, VCount=division)  # disabled
number_slider_8 = Slider(4, range=0..10)  # disabled
brep = Brep(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)  # disabled
sbox = SurfaceBox(Surface=srf_2, Domain=divide, Height=number_slider_8)  # disabled
box = Box(brep)  # disabled
morph = BoxMorph(Geometry=brep, Reference=box, Target=sbox)  # disabled

srf_3 = Surface(srfgrid)  # disabled
dim_2 = Dimensions(Surface=srf_3)  # -> UDimension, VDimension; disabled
expression = Expression(x=dim_2.VDimension, Expression="sqrt(x²-(x/2)²)")  # disabled
trigrid = Triangular(Plane=PlaneXY(0, 0, 0), Size=1, ExtentX=dim_2.UDimension, ExtentY=expression)  # -> flatten(Cells), Points; disabled
bbox = BoundingBox(Content=trigrid.Cells, Plane=PlaneXY(0, 0, 0), UnionBox=True)  # -> Box, Box_2; disabled
map_srf = MapToSurface(Curve=trigrid.Cells, Source=bbox.Box, Target=srf_3)  # disabled
explode = Explode(Curve=map_srf, Recursive=True)  # -> Segments, Vertices; disabled
srf_4 = Surface(map_srf)  # disabled
panel_2 = Panel("0")  # disabled
cull_i = CullIndex(List=explode.Vertices, Indices=panel_2, Wrap=True)  # disabled
number_slider_9 = Slider(2, range=0..10)  # disabled
nurbs = NurbsCurve(Vertices=cull_i, Degree=number_slider_9, Periodic=True)  # -> Curve, Length, Domain; disabled

srf_5 = Surface(srfgrid)  # disabled
dim_3 = Dimensions(Surface=srf_5)  # -> UDimension, VDimension; disabled
rectangle_2 = Rectangle(Plane=PlaneXY(0, 0, 0), XSize=dim_3.UDimension, YSize=dim_3.VDimension, Radius=0)  # -> Rectangle, Length; disabled
number_slider_10 = Slider(28, range=0..100)  # disabled
srf_6 = Surface(reparameterize(rectangle_2.Rectangle))  # disabled
boundary = BoundarySurfaces(Edges=rectangle_2.Rectangle)  # -> reparameterize(Surfaces); disabled
division_3 = Division(A=dim_3.UDimension, B=number_slider_10)  # disabled
number_slider_11 = Slider(0.1, range=0..0.1)  # disabled
sdivide_2 = DivideSurface(Surface=boundary, UCount=number_slider_10, VCount=number_slider_10)  # -> flatten(Points), Normals, flatten(Parameters); disabled
image = ImageSampler(sdivide_2.Parameters, Filter="Value", Interpolate=False, Umax=1, Umin=0, Vmax=1, Vmin=0, Wrap=1)  # disabled
bnd_2 = Bounds(Numbers=image)  # disabled
dom = ConstructDomain(DomainStart=number_slider_11, DomainEnd=expr("x/2", division_3))  # disabled
dom_2 = ConstructDomain(DomainStart=expr("x/2", division_3), DomainEnd=number_slider_11)  # disabled
remap_2 = RemapNumbers(Value=image, Source=bnd_2, Target=dom)  # -> Mapped, Clipped; disabled
cir = Circle(Plane=sdivide_2.Points, Radius=remap_2.Mapped)  # disabled
bbox_2 = BoundingBox(Content=cir, Plane=PlaneXY(0, 0, 0), UnionBox=True)  # -> Box, Box_2; disabled
srf_7 = Surface(srfgrid)  # disabled
map_srf_2 = MapToSurface(Curve=cir, Source=bbox_2.Box, Target=srf_7)  # disabled

srf_8 = Surface(reparameterize(srfgrid))  # disabled
dim_4 = Dimensions(Surface=srf_8)  # -> UDimension, VDimension; disabled
rectangle_3 = Rectangle(Plane=PlaneXY(0, 0, 0), XSize=dim_4.UDimension, YSize=dim_4.VDimension, Radius=0)  # -> Rectangle, Length; disabled
number_slider_12 = Slider(33, range=0..100)  # disabled
number_slider_13 = Slider(50, range=0..100)  # disabled
pop2d = Populate2D(Region=rectangle_3.Rectangle, Count=number_slider_13, Seed=number_slider_12)  # disabled
number_slider_14 = Slider(0.9, range=0..1)  # disabled
voronoi = Voronoi(Points=pop2d, Boundary=rectangle_3.Rectangle, BruteForceOverride=False)  # disabled
area = Area(Geometry=voronoi)  # -> Area, Centroid; disabled
scale = Scale(Geometry=voronoi, Center=area.Centroid, Factor=number_slider_14)  # -> Geometry, Transform; disabled
rdiff = RegionDifference(CurvesA=rectangle_3.Rectangle, CurvesB=scale.Geometry)  # disabled
boundary_2 = BoundarySurfaces(Edges=rdiff)  # disabled
Z_2 = UnitZ(Factor=1)  # disabled
extr = Extrude(Base=boundary_2, Direction=Z_2)  # disabled
panel_3 = Panel("0 to 1")  # disabled
panel_4 = Panel("0 to 0.2")  # disabled
box_2 = Box(extr)  # disabled
srfmorph = SurfaceMorph(Geometry=extr, Reference=box_2, Surface=srf_8, UDomain=panel_3, VDomain=panel_3, WDomain=panel_4)  # disabled

srf_9 = Surface(srfgrid)  # disabled
dim_5 = Dimensions(Surface=srf_9)  # -> UDimension, VDimension; disabled
expression_2 = Expression(x=dim_5.VDimension, Expression="sqrt(x²-(x/2)²)")  # disabled
hexgrid = Hexagonal(Plane=PlaneXY(0, 0, 0), Size=1, ExtentX=dim_5.UDimension, ExtentY=expression_2)  # -> flatten(Cells), Points; disabled
bbox_3 = BoundingBox(Content=hexgrid.Cells, Plane=PlaneXY(0, 0, 0), UnionBox=True)  # -> Box, Box_2; disabled
map_srf_3 = MapToSurface(Curve=hexgrid.Cells, Source=bbox_3.Box, Target=srf_9)  # disabled
explode_2 = Explode(Curve=map_srf_3, Recursive=True)  # -> Segments, Vertices; disabled
panel_5 = Panel("0")  # disabled
cull_i_2 = CullIndex(List=explode_2.Vertices, Indices=panel_5, Wrap=True)  # disabled
number_slider_15 = Slider(2, range=0..10)  # disabled
nurbs_2 = NurbsCurve(Vertices=cull_i_2, Degree=number_slider_15, Periodic=True)  # -> Curve, Length, Domain; disabled

# ---- group: LADRILLOS
# dimensiones de un ladrillo
# .24*.15*.05
number_slider_16 = Slider(0.1, range=0..0.1)  # disabled
number_slider_17 = Slider(0.46, range=0..1)  # disabled
number_slider_18 = Slider(0.3, range=0..1)  # disabled
srf_10 = Surface(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)  # disabled
contour = Contour(Shape=srf_10, Point=Point(0, 0, 0), Direction=Vector(0, 0, 1), Distance=number_slider_16)  # -> flatten(Contours); disabled
dispatch = Dispatch(List=contour, DispatchPattern=[True, False])  # -> ListA, ListB; disabled
division_4 = Division(A=number_slider_17, B=2)  # disabled
len = Length(Curve=dispatch.ListB)  # disabled
len_2 = Length(Curve=dispatch.ListA)  # disabled
division_5 = Division(A=len_2, B=division_4)  # disabled
division_6 = Division(A=len, B=division_4)  # disabled
hframes = HorizontalFrames(Curve=dispatch.ListA, Count=division_5)  # -> Frames, Parameters; disabled
hframes_2 = HorizontalFrames(Curve=dispatch.ListB, Count=division_6)  # -> Frames, Parameters; disabled
panel_6 = Panel("""0
1""")  # disabled
cull = CullPattern(List=hframes_2.Frames, CullPattern=invert(panel_6))  # disabled
cull_2 = CullPattern(List=hframes.Frames, CullPattern=panel_6)  # disabled
box_3 = CenterBox(Base=[cull, cull_2], X=expr("X/2", number_slider_17), Y=expr("X/2", number_slider_18), Z=expr("X/2", number_slider_16))  # disabled

# ----
number_slider_19 = Slider(7, range=0..10)  # disabled
number_slider_20 = Slider(9, range=0..100)  # disabled
rec = Rectangle({Plane=PlaneXY(33.12334602, 17.23342031, 0), Size=Domain2(u=-7.927395447..7.927395447, v=-7.927395447..7.927395447)})  # disabled
number_slider_21 = Slider(0.8, range=0..10)  # disabled
brep_2 = Brep(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)  # disabled
sdivide_3 = DivideSurface(Surface=rec, UCount=number_slider_19, VCount=number_slider_19)  # -> flatten(Points), Normals, Parameters; disabled
number_slider_22 = Slider(5, range=0..10)  # disabled
lng = ListLength(List=sdivide_3.Points)  # disabled
box_4 = Box(brep_2)  # disabled
panel_7 = Panel("0 to 4")  # disabled
random = Random(Range=panel_7, Number=lng, Seed=number_slider_22)  # disabled
Z_3 = UnitZ(Factor=random)  # disabled
move_2 = Move(Geometry=sdivide_3.Points, Motion=Z_3)  # -> Geometry, Transform; disabled
srfgrid_2 = SurfaceFromPoints(Points=move_2.Geometry, UCount=expr("x+1", number_slider_19), Interpolate=False)  # disabled
srf_11 = Surface(srfgrid_2)  # disabled
srf_12 = Surface(srfgrid_2)  # disabled
divide_2 = DivideDomain²(Domain=srf_12, UCount=number_slider_20, VCount=number_slider_20)  # disabled
sbox_2 = SurfaceBox(Surface=srf_12, Domain=divide_2, Height=number_slider_21)  # disabled
morph_2 = BoxMorph(Geometry=brep_2, Reference=box_4, Target=sbox_2)  # disabled
number_slider_23 = Slider(12, range=0..100)  # disabled
rec_2 = Rectangle({Plane=PlaneXY(39.0432799, 18.00931985, 0), Size=Domain2(u=-9.216612259..9.216612259, v=-9.216612259..9.216612259)})  # disabled
srf_13 = Surface(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)  # disabled
number_slider_24 = Slider(45, range=0..100)  # disabled
number_slider_25 = Slider(76, range=0..100)  # disabled
sph = Sphere(Base=PlaneXY(0, 0, 0), Radius=number_slider_23)  # disabled
dim_6 = Dimensions(Surface=sph)  # -> UDimension, VDimension; disabled
number_slider_26 = Slider(65, range=0..100)  # disabled
rectangle_4 = Rectangle(Plane=PlaneXY(0, 0, 0), XSize=dim_6.UDimension, YSize=dim_6.VDimension, Radius=0)  # -> Rectangle, Length; disabled
srf_14 = Surface(srf_13)  # disabled
srf_15 = Surface(rectangle_4.Rectangle)  # disabled
crv_2 = Curve(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)  # disabled
volume = Volume(Geometry=sph)  # -> Volume, Centroid; disabled
sdivide_4 = DivideSurface(Surface=srf_14, UCount=number_slider_24, VCount=number_slider_24)  # -> flatten(Points), Normals, Parameters; disabled
crv_3 = Curve([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])  # disabled
sdivide_5 = DivideSurface(Surface=reparameterize(srf_15), UCount=number_slider_25, VCount=number_slider_26)  # -> flatten(Points), Normals, flatten(Parameters); disabled
bbox_4 = BoundingBox(Content=crv_2, Plane=PlaneXY(0, 0, 0), UnionBox=True)  # -> Box, Box_2; disabled
sdivide_6 = DivideSurface(Surface=sph, UCount=number_slider_25, VCount=number_slider_26)  # -> flatten(Points), Normals, Parameters; disabled
pull_2 = PullPoint(Point=sdivide_4.Points, Geometry=crv_3, ClosestOnly=True)  # -> ClosestPoint, Distance; disabled
pdecon = Deconstruct(Point=sdivide_4.Points)  # -> XComponent, YComponent, ZComponent; disabled
panel_8 = Panel("5 to 0")  # disabled
bnd_3 = Bounds(Numbers=pull_2.Distance)  # disabled
image_2 = ImageSampler(sdivide_5.Parameters, Filter="Value", Interpolate=False, Umax=1, Umin=0, Vmax=1, Vmin=0, Wrap=1)  # disabled
vec2pt = Vector2Pt(PointA=volume.Centroid, PointB=sdivide_6.Points, Unitize=False)  # -> Vector, Length; disabled
remap_3 = RemapNumbers(Value=pull_2.Distance, Source=bnd_3, Target=panel_8)  # -> Mapped, Clipped; disabled
pt = ConstructPoint(XCoordinate=pdecon.XComponent, YCoordinate=pdecon.YComponent, ZCoordinate=remap_3.Mapped)  # disabled
panel_9 = Panel("0 to 12")  # disabled
panel_10 = Panel(bnd_3)  # disabled
panel_11 = Panel("0 to 3")  # disabled
partition = PartitionList(List=pt, Size=expr("x+1", number_slider_24))  # disabled
remap_4 = RemapNumbers(Value=image_2, Source=Domain(0, 1), Target=panel_11)  # -> Mapped, Clipped; disabled
remap_5 = RemapNumbers(Value=image_2, Source=Domain(0, 1), Target=panel_9)  # -> Mapped, Clipped; disabled
srfgrid_3 = SurfaceFromPoints(Points=pt, UCount=expr("x+1", number_slider_24), Interpolate=False)  # disabled
srf_16 = Surface(srfgrid_3)  # disabled
srf_17 = Surface(srfgrid_3)  # disabled
srf_18 = Surface(srfgrid_3)  # disabled
dim_7 = Dimensions(Surface=srf_17)  # -> UDimension, VDimension; disabled
dim_8 = Dimensions(Surface=srf_18)  # -> UDimension, VDimension; disabled
expression_3 = Expression(x=dim_8.UDimension, Expression="sqrt(x²-(x/2)²)")  # disabled
expression_4 = Expression(x=dim_7.UDimension, Expression="sqrt(x²-(x/2)²)")  # disabled
trigrid_2 = Triangular(Plane=PlaneXY(0, 0, 0), Size=1, ExtentX=expression_3, ExtentY=dim_8.VDimension)  # -> flatten(Cells), Points; disabled
hexgrid_2 = Hexagonal(Plane=PlaneXY(0, 0, 0), Size=1, ExtentX=expression_4, ExtentY=dim_7.VDimension)  # -> flatten(Cells), Points; disabled
bbox_5 = BoundingBox(Content=hexgrid_2.Cells, Plane=PlaneXY(0, 0, 0), UnionBox=True)  # -> Box, Box_2; disabled
bbox_6 = BoundingBox(Content=trigrid_2.Cells, Plane=PlaneXY(0, 0, 0), UnionBox=True)  # -> Box, Box_2; disabled
map_srf_4 = MapToSurface(Curve=trigrid_2.Cells, Source=bbox_6.Box, Target=srf_18)  # disabled
map_srf_5 = MapToSurface(Curve=crv_2, Source=bbox_4.Box, Target=srf_18)  # disabled
map_srf_6 = MapToSurface(Curve=hexgrid_2.Cells, Source=bbox_5.Box, Target=srf_17)  # disabled
explode_3 = Explode(Curve=map_srf_6, Recursive=True)  # -> Segments, Vertices; disabled
explode_4 = Explode(Curve=map_srf_4, Recursive=True)  # -> Segments, Vertices; disabled
project = Project(Curve=map_srf_5, Brep=srf_18, Direction=Vector(0, 0, 1))  # disabled
# quiero eliminar el ultimo valor
lng_2 = ListLength(List=explode_3.Vertices)  # disabled
# quiero eliminar el ultimo valor
lng_3 = ListLength(List=explode_4.Vertices)  # disabled
Z_4 = UnitZ(Factor=1)  # disabled
panel_12 = Panel("0")  # disabled
panel_13 = Panel("0")  # disabled
amp = Amplitude(Vector=vec2pt.Vector, Amplitude=remap_4.Mapped)  # disabled
cull_i_3 = CullIndex(List=reverse(explode_4.Vertices), Indices=panel_12, Wrap=True)  # -> reverse(List); disabled
amp_2 = Amplitude(Vector=Z_4, Amplitude=remap_5.Mapped)  # disabled
cull_i_4 = CullIndex(List=reverse(explode_3.Vertices), Indices=panel_13, Wrap=True)  # -> reverse(List); disabled
cull_i_5 = CullIndex(List=explode_3.Vertices, Indices=expr("x-1", lng_2), Wrap=True)  # disabled
cull_i_6 = CullIndex(List=explode_4.Vertices, Indices=expr("x-1", lng_3), Wrap=True)  # disabled
move_3 = Move(Geometry=sdivide_6.Points, Motion=amp)  # -> Geometry, Transform; disabled
move_4 = Move(Geometry=sdivide_5.Points, Motion=amp_2)  # -> Geometry, Transform; disabled
number_slider_27 = Slider(2, range=0..10)  # disabled
toggle = BooleanToggle(False)  # disabled
number_slider_28 = Slider(2, range=0..10)  # disabled
srfgrid_4 = SurfaceFromPoints(Points=move_3.Geometry, UCount=expr("x+1", number_slider_25), Interpolate=False)  # disabled
number_slider_29 = Slider(0.3, range=0..1)  # disabled
srfgrid_5 = SurfaceFromPoints(Points=move_4.Geometry, UCount=expr("x+1", number_slider_25), Interpolate=False)  # disabled
toggle_2 = BooleanToggle(True)  # disabled
nurbs_3 = NurbsCurve(Vertices=cull_i_3, Degree=number_slider_27, Periodic=toggle)  # -> Curve, Length, Domain; disabled
nurbs_4 = NurbsCurve(Vertices=cull_i_4, Degree=number_slider_28, Periodic=toggle_2)  # -> Curve, Length, Domain; disabled
contour_2 = Contour(Shape=srfgrid_5, Point=Point(0, 0, 0), Direction=Vector(0, 0, 1), Distance=number_slider_29)  # -> flatten(Contours); disabled
map_srf_7 = MapToSurface(Curve=contour_2, Source=srfgrid_5, Target=srfgrid_4)  # disabled

yz = YZPlane(Origin=Point(0, 0, 0))  # disabled
number_slider_30 = Slider(43, range=0..100)  # disabled
number_slider_31 = Slider(2, range=0..10)  # disabled
number_slider_32 = Slider(3, range=0..10)  # disabled
number_slider_33 = Slider(24, range=0..100)  # disabled
recgrid = Rectangular(Plane=yz, SizeX=number_slider_31, SizeY=number_slider_32, ExtentX=number_slider_33, ExtentY=number_slider_30)  # -> Cells, Points; disabled
flip = FlipMatrix(Data=recgrid.Points)  # -> flatten(Data); disabled
pt_2 = Point(Point(1.81925698, 24.16074653, 73.2761291))  # disabled
pt_3 = Point(flip)  # disabled
dist = Distance(PointA=pt_3, PointB=pt_2)  # disabled
panel_14 = Panel("15 to 0")  # disabled
bnd_4 = Bounds(Numbers=dist)  # disabled
remap_6 = RemapNumbers(Value=dist, Source=bnd_4, Target=panel_14)  # -> Mapped, Clipped; disabled
X = UnitX(Factor=remap_6.Mapped)  # disabled
number_slider_34 = Slider(0.035, range=0..0.1)  # disabled
move_5 = Move(Geometry=pt_3, Motion=X)  # -> Geometry, Transform; disabled
partition_2 = PartitionList(List=move_5.Geometry, Size=expr("x+1", number_slider_33))  # disabled
flip_2 = FlipMatrix(Data=partition_2)  # disabled
X_2 = UnitX(Factor=number_slider_34)  # disabled
move_6 = Move(Geometry=move_5.Geometry, Motion=X_2)  # -> Geometry, Transform; disabled
pline = PolyLine(Vertices=flip_2, Closed=False)  # -> flatten(Polyline); disabled
panel_15 = Panel("""1
0
0
0""")  # disabled
dist_2 = Distance(PointA=move_6.Geometry, PointB=pt_2)  # disabled
xy = XYPlane(Origin=move_6.Geometry)  # disabled
panel_16 = Panel("70 to 0")  # disabled
number_slider_35 = Slider(0.3, range=0..1)  # disabled
pline_2 = PolyLine(Vertices=partition_2, Closed=False)  # disabled
cull_3 = CullPattern(List=pline, CullPattern=panel_15)  # disabled
bnd_5 = Bounds(Numbers=dist_2)  # disabled
Y = UnitY(Factor=1)  # disabled
remap_7 = RemapNumbers(Value=dist_2, Source=bnd_5, Target=panel_16)  # -> Mapped, Clipped; disabled
pipe = Pipe(Curve=[cull_3, pline_2], Radius=number_slider_35, Caps=0)  # disabled
rot3d = Rotate3D(Geometry=xy, Angle=degrees(remap_7.Mapped), Center=xy, Axis=Y)  # -> Geometry, Transform; disabled
panel_17 = Panel("""1
0""")  # disabled
cull_4 = CullPattern(List=rot3d.Geometry, CullPattern=panel_17)  # disabled
pln = Plane(cull_4)  # disabled
number_slider_36 = Slider(1.3, range=0..10)  # disabled
panel_18 = Panel("-1.7 to 1.7")  # disabled
panel_19 = Panel("0 to 5")  # disabled
number_slider_37 = Slider(0.2, range=0..1)  # disabled
pdecon_2 = Deconstruct(Point=pln)  # -> XComponent, YComponent, ZComponent; disabled
rectangle_5 = Rectangle(Plane=pln, XSize=panel_19, YSize=panel_18, Radius=number_slider_36)  # -> Rectangle, Length; disabled
deplane = DeconstructPlane(Plane=pln)  # -> Origin, XAxis, YAxis, ZAxis; disabled
bnd_6 = Bounds(Numbers=pdecon_2.ZComponent)  # disabled
lng_4 = ListLength(List=pdecon_2.ZComponent)  # disabled
amp_3 = Amplitude(Vector=deplane.ZAxis, Amplitude=number_slider_37)  # disabled
escamas_srf = Surface(rectangle_5.Rectangle)  # disabled
random_2 = Random(Range=Domain(0, 1), Number=lng_4, Seed=2)  # disabled
remap_8 = RemapNumbers(Value=pdecon_2.ZComponent, Source=bnd_6, Target=Domain(0, 1))  # -> Mapped, Clipped; disabled
graph = GraphMapper(
    remap_8.Mapped,
    x0=0,
    x1=1,
    y0=0,
    y1=1,
    container_name="Bezier",
    cpx=[0, 0.5113636255, 0.5811608434, 1],
    cpy=[0, 0.3181818128, 0.8851448894, 1])  # disabled
extr_2 = Extrude(Base=escamas_srf, Direction=amp_3)  # disabled
larger = LargerThan(FirstNumber=graph, SecondNumber=random_2)  # -> LargerThan, OrEqualTo; disabled
cull_5 = CullPattern(List=extr_2, CullPattern=invert(larger.LargerThan))  # disabled
cull_6 = CullPattern(List=extr_2, CullPattern=larger.LargerThan)  # disabled
jitter = Jitter(List=cull_6, Jitter=1, Seed=2)  # -> Values, Indices; disabled
jitter_2 = Jitter(List=cull_5, Jitter=1, Seed=2)  # -> Values, Indices; disabled
dispatch_2 = Dispatch(List=jitter.Values, DispatchPattern=[True, False])  # -> ListA, ListB; disabled
dispatch_3 = Dispatch(List=jitter_2.Values, DispatchPattern=[True, False])  # -> ListA, ListB; disabled
brep_3 = Brep(dispatch_3.ListA)  # disabled
brep_4 = Brep(dispatch_2.ListB)  # disabled
brep_5 = Brep(dispatch_2.ListA)  # disabled
brep_6 = Brep(dispatch_3.ListB)  # disabled
swatch = ColourSwatch(SwatchColor=RGB(55, 125, 111))  # disabled
swatch_2 = ColourSwatch(SwatchColor=RGB(84, 176, 152))  # disabled
swatch_3 = ColourSwatch(SwatchColor=RGB(173, 128, 173))  # disabled
swatch_4 = ColourSwatch(SwatchColor=RGB(145, 108, 145))  # disabled
preview = CustomPreview(Geometry=brep_4, Material=swatch)  # disabled
preview_2 = CustomPreview(Geometry=brep_5, Material=swatch_2)  # disabled
preview_3 = CustomPreview(Geometry=brep_3, Material=swatch_4)  # disabled
preview_4 = CustomPreview(Geometry=brep_6, Material=swatch_3)  # disabled

crv_4 = Curve([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])  # disabled
number_slider_38 = Slider(96, range=0..100)  # disabled
number_slider_39 = Slider(42, range=0..100)  # disabled
loft = Loft(Curves=crv_4, Options={Adjust=False, Closed=False, LoftEnds=0, LoftSimp=0, LoftType=0, Rebuild=10, Refit=0.01})  # disabled
sdivide_7 = DivideSurface(Surface=loft, UCount=number_slider_39, VCount=number_slider_38)  # -> Points, Normals, Parameters; disabled
evalsrf = EvaluateSurface(Surface=loft, Point=sdivide_7.Parameters)  # -> Point, Normal, UDirection, VDirection, flatten(Frame); disabled
panel_20 = Panel("""1
0""")  # disabled
cull_7 = CullPattern(List=evalsrf.Frame, CullPattern=panel_20)  # disabled
pln_2 = Plane(cull_7)  # disabled
deplane_2 = DeconstructPlane(Plane=pln_2)  # -> Origin, XAxis, YAxis, ZAxis; disabled
panel_21 = Panel("-1")  # disabled
amp_4 = Amplitude(Vector=deplane_2.XAxis, Amplitude=panel_21)  # disabled
amp_5 = Amplitude(Vector=deplane_2.XAxis, Amplitude=1)  # disabled
move_7 = Move(Geometry=deplane_2.Origin, Motion=amp_5)  # -> Geometry, Transform; disabled
move_8 = Move(Geometry=deplane_2.Origin, Motion=amp_4)  # -> Geometry, Transform; disabled
pdecon_3 = Deconstruct(Point=move_8.Geometry)  # -> XComponent, YComponent, ZComponent; disabled
pdecon_4 = Deconstruct(Point=move_7.Geometry)  # -> XComponent, YComponent, ZComponent; disabled
subtraction = Subtraction(A=pdecon_4.ZComponent, B=pdecon_3.ZComponent)  # disabled
panel_22 = Panel("40 to -30")  # disabled
bnd_7 = Bounds(Numbers=subtraction)  # disabled
remap_9 = RemapNumbers(Value=subtraction, Source=bnd_7, Target=panel_22)  # -> Mapped, Clipped; disabled
rot3d_2 = Rotate3D(Geometry=pln_2, Angle=degrees(remap_9.Mapped), Center=pln_2, Axis=deplane_2.YAxis)  # -> Geometry, Transform; disabled
pln_3 = Plane(rot3d_2.Geometry)  # disabled
number_slider_40 = Slider(1.3, range=0..10)  # disabled
panel_23 = Panel("-3 to 3")  # disabled
number_slider_41 = Slider(0.2, range=0..1)  # disabled
panel_24 = Panel("-9 to 0")  # disabled
pdecon_5 = Deconstruct(Point=pln_3)  # -> XComponent, YComponent, ZComponent; disabled
deplane_3 = DeconstructPlane(Plane=pln_3)  # -> Origin, XAxis, YAxis, ZAxis; disabled
rectangle_6 = Rectangle(Plane=pln_3, XSize=panel_24, YSize=panel_23, Radius=number_slider_40)  # -> Rectangle, Length; disabled
bnd_8 = Bounds(Numbers=pdecon_5.ZComponent)  # disabled
lng_5 = ListLength(List=pdecon_5.ZComponent)  # disabled
amp_6 = Amplitude(Vector=deplane_3.ZAxis, Amplitude=number_slider_41)  # disabled
escamas_srf_2 = Surface(rectangle_6.Rectangle)  # disabled
random_3 = Random(Range=Domain(0, 1), Number=lng_5, Seed=2)  # disabled
remap_10 = RemapNumbers(Value=pdecon_5.ZComponent, Source=bnd_8, Target=Domain(0, 1))  # -> Mapped, Clipped; disabled
graph_2 = GraphMapper(
    remap_10.Mapped,
    x0=0,
    x1=1,
    y0=0,
    y1=1,
    container_name="Bezier",
    cpx=[0, 0.5113636255, 0.5811608434, 1],
    cpy=[0, 0.3181818128, 0.8851448894, 1])  # disabled
extr_3 = Extrude(Base=escamas_srf_2, Direction=amp_6)  # disabled
larger_2 = LargerThan(FirstNumber=graph_2, SecondNumber=random_3)  # -> LargerThan, OrEqualTo; disabled
cull_8 = CullPattern(List=extr_3, CullPattern=invert(larger_2.LargerThan))  # disabled
cull_9 = CullPattern(List=extr_3, CullPattern=larger_2.LargerThan)  # disabled
jitter_3 = Jitter(List=cull_9, Jitter=1, Seed=2)  # -> Values, Indices; disabled
jitter_4 = Jitter(List=cull_8, Jitter=1, Seed=2)  # -> Values, Indices; disabled
dispatch_4 = Dispatch(List=jitter_3.Values, DispatchPattern=[True, False])  # -> ListA, ListB; disabled
dispatch_5 = Dispatch(List=jitter_4.Values, DispatchPattern=[True, False])  # -> ListA, ListB; disabled
brep_7 = Brep(dispatch_5.ListA)  # disabled
brep_8 = Brep(dispatch_4.ListB)  # disabled
brep_9 = Brep(dispatch_4.ListA)  # disabled
brep_10 = Brep(dispatch_5.ListB)  # disabled
swatch_5 = ColourSwatch(SwatchColor=RGB(55, 125, 111))  # disabled
swatch_6 = ColourSwatch(SwatchColor=RGB(84, 176, 152))  # disabled
swatch_7 = ColourSwatch(SwatchColor=RGB(145, 108, 145))  # disabled
swatch_8 = ColourSwatch(SwatchColor=RGB(173, 128, 173))  # disabled
preview_5 = CustomPreview(Geometry=brep_8, Material=swatch_5)  # disabled
preview_6 = CustomPreview(Geometry=brep_9, Material=swatch_6)  # disabled
preview_7 = CustomPreview(Geometry=brep_7, Material=swatch_7)  # disabled
preview_8 = CustomPreview(Geometry=brep_10, Material=swatch_8)  # disabled

number_slider_42 = Slider(76, range=0..100)  # disabled
geo = Geometry(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)  # disabled
divide_3 = DivideCurve(Curve=geo, Count=number_slider_42, Kinks=False)  # -> Points, Tangents, Parameters; disabled
voronoi_2 = Voronoi(Points=divide_3.Points, BruteForceOverride=False)  # disabled
explode_5 = Explode(Curve=voronoi_2, Recursive=True)  # -> Segments, Vertices; disabled
trim = TrimWithRegion(Curve=explode_5.Segments, Region=geo)  # -> Inside, Outside; disabled
crv_5 = Curve(trim.Inside)  # disabled
panel_25 = Panel("2")  # disabled
trim_2 = TrimTree(Tree=crv_5, Depth=panel_25)  # disabled
number_slider_43 = Slider(0, range=0..10)  # disabled
dupln = RemoveDuplicateLines(Lines=trim_2, Tolerance=0.01)  # disabled
colom = CollisionOneMany(Collider=dupln, Obstacles=geo)  # -> Collision, Index; disabled
dispatch_6 = Dispatch(List=dupln, DispatchPattern=colom.Collision)  # -> ListA, ListB; disabled
crv_6 = Curve(dispatch_6.ListA)  # disabled
crv_7 = Curve(dispatch_6.ListB)  # disabled
number_slider_44 = Slider(0.1, range=0..0.1)  # disabled
end = EndPoints(Curve=crv_6)  # -> Start, End; disabled
explode_6 = Explode(Curve=crv_7, Recursive=True)  # -> Segments, Vertices; disabled
pull_3 = PullPoint(Point=end.End, Geometry=geo, ClosestOnly=True)  # -> ClosestPoint, Distance; disabled
number_slider_45 = Slider(0.61, range=0..10)  # disabled
pull_4 = PullPoint(Point=explode_6.Vertices, Geometry=geo, ClosestOnly=True)  # -> ClosestPoint, Distance; disabled
larger_3 = LargerThan(FirstNumber=pull_3.Distance, SecondNumber=number_slider_44)  # -> LargerThan, OrEqualTo; disabled
cull_10 = CullPattern(List=crv_6, CullPattern=larger_3.LargerThan)  # disabled
cull_11 = CullPattern(List=crv_6, CullPattern=invert(larger_3.LargerThan))  # disabled
flip_3 = FlipCurve(Curve=cull_11)  # -> Curve, Flag; disabled
multiplication = Multiplication(A=pull_4.Distance, B=number_slider_45)  # disabled
merge = Merge(Data1=cull_10, Data2=flip_3.Curve)  # disabled
Z_5 = UnitZ(Factor=multiplication)  # disabled
end_2 = EndPoints(Curve=merge)  # -> Start, End; disabled
move_9 = Move(Geometry=explode_6.Vertices, Motion=Z_5)  # -> Geometry, Transform; disabled
pull_5 = PullPoint(Point=end_2.End, Geometry=geo, ClosestOnly=True)  # -> ClosestPoint, Distance; disabled
multiplication_2 = Multiplication(A=pull_5.Distance, B=number_slider_45)  # disabled
pt_4 = Point(end_2.End)  # disabled
item = ListItem(List=move_9.Geometry, Index=0, Wrap=True)  # -> Item, Item1; disabled
Z_6 = UnitZ(Factor=multiplication_2)  # disabled
move_10 = Move(Geometry=end_2.End, Motion=Z_6)  # -> Geometry, Transform; disabled
ln = Line(StartPoint=item.Item, EndPoint=item.Item1)  # disabled
ln_2 = Line(StartPoint=end_2.Start, EndPoint=move_10.Geometry)  # disabled
crv_8 = Curve([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])  # disabled
number_slider_46 = Slider(23, range=0..100)  # disabled
number_slider_47 = Slider(62, range=0..100)  # disabled
loft_2 = Loft(Curves=crv_8, Options={Adjust=False, Closed=False, LoftEnds=0, LoftSimp=0, LoftType=0, Rebuild=10, Refit=0.01})  # disabled
sframes = SurfaceFrames(Surface=loft_2, UCount=number_slider_46, VCount=number_slider_47)  # -> Frames, Parameters; disabled
panel_26 = Panel("""1
0""")  # disabled
cull_12 = CullPattern(List=flatten(sframes.Frames), CullPattern=panel_26)  # disabled
pt_5 = Point(flatten(cull_12))  # disabled
flip_4 = FlipMatrix(Data=pt_5)  # disabled
number_slider_48 = Slider(53, range=0..100)  # disabled
deplane_4 = DeconstructPlane(Plane=cull_12)  # -> Origin, XAxis, YAxis, ZAxis; disabled
Z_7 = UnitZ(Factor=1)  # disabled
number_slider_49 = Slider(64, range=0..100)  # disabled
pline_3 = PolyLine(Vertices=flip_4, Closed=False)  # disabled
pline_4 = PolyLine(Vertices=pt_5, Closed=False)  # disabled
angle = Angle(VectorA=deplane_4.XAxis, VectorB=Z_7)  # -> Angle, Reflex; disabled
index = ItemIndex(List=pt_5, Item=pt_5)  # disabled
deg = Degrees(Radians=angle.Angle)  # disabled
neg = Negative(Value=number_slider_48)  # disabled
number_slider_50 = Slider(272, range=0..1000)  # disabled
number_slider_51 = Slider(200, range=0..1000)  # disabled
bnd_9 = Bounds(Numbers=deg)  # disabled
crv_9 = Curve(<curve referenced from the Rhino model>)  # disabled
tag = TextTag(Location=flatten(pt_5), Text=index)  # disabled
dom_3 = ConstructDomain(DomainStart=neg, DomainEnd=number_slider_49)  # disabled
crv_10 = Curve(<curve referenced from the Rhino model>)  # disabled
remap_11 = RemapNumbers(Value=deg, Source=bnd_9, Target=dom_3)  # -> Mapped, Clipped; disabled
number_slider_52 = Slider(0.4, range=0..1)  # disabled
divide_4 = DivideCurve(Curve=crv_9, Count=number_slider_50, Kinks=False)  # -> Points, Tangents, Parameters; disabled
voronoi_3 = Voronoi(Points=divide_4.Points, BruteForceOverride=False)  # disabled
number_slider_53 = Slider(0.8, range=0..1)  # disabled
popgeo = PopulateGeometry(Geometry=crv_10, Count=number_slider_51, Seed=1)  # disabled
rot3d_3 = Rotate3D(Geometry=cull_12, Angle=degrees(remap_11.Mapped), Center=deplane_4.Origin, Axis=deplane_4.YAxis)  # -> Geometry, Transform; disabled
trim_3 = TrimWithRegion(Curve=voronoi_3, Region=crv_9)  # -> flatten(Inside), Outside; disabled
neg_2 = Negative(Value=number_slider_52)  # disabled
panel_27 = Panel("0")  # disabled
neg_3 = Negative(Value=number_slider_53)  # disabled
pln_4 = Plane(Plane(origin=(-2.24153208, 204.37119, 0), x=(-1, 0, 0), y=(0, 1, 0)))  # disabled
voronoi_4 = Voronoi(Points=popgeo, BruteForceOverride=False)  # disabled
brep_11 = Brep(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)  # disabled
explode_7 = Explode(Curve=trim_3.Inside, Recursive=True)  # -> Segments, Vertices; disabled
dom_4 = ConstructDomain(DomainStart=panel_27, DomainEnd=neg_3)  # disabled
dom_5 = ConstructDomain(DomainStart=neg_2, DomainEnd=number_slider_52)  # disabled
colom_2 = CollisionOneMany(Collider=explode_7.Segments, Obstacles=crv_9)  # -> Collision, Index; disabled
deplane_5 = DeconstructPlane(Plane=rot3d_3.Geometry)  # -> Origin, XAxis, YAxis, ZAxis; disabled
rectangle_7 = Rectangle(Plane=rot3d_3.Geometry, XSize=dom_4, YSize=dom_5, Radius=0)  # -> Rectangle, Length; disabled
deplane_6 = DeconstructPlane(Plane=rot3d_3.Geometry)  # -> Origin, XAxis, YAxis, ZAxis; disabled
orient = Orient(Geometry=brep_11, Source=pln_4, Target=rot3d_3.Geometry)  # -> Geometry, Transform; disabled
end_3 = EndPoints(Curve=flatten(explode_7.Segments))  # -> Start, End; disabled
cull_13 = CullPattern(List=explode_7.Segments, CullPattern=invert(colom_2.Collision))  # -> flatten(List); disabled
pdecon_6 = Deconstruct(Point=deplane_5.Origin)  # -> XComponent, YComponent, ZComponent; disabled
cull_14 = CullPattern(List=explode_7.Segments, CullPattern=colom_2.Collision)  # -> flatten(List); disabled
pdecon_7 = Deconstruct(Point=deplane_6.Origin)  # -> XComponent, YComponent, ZComponent; disabled
srf_19 = Surface(rectangle_7.Rectangle)  # disabled
bnd_10 = Bounds(Numbers=pdecon_7.ZComponent)  # disabled
lng_6 = ListLength(List=pdecon_7.ZComponent)  # disabled
bnd_11 = Bounds(Numbers=pdecon_6.ZComponent)  # disabled
dupln_2 = RemoveDuplicateLines(Lines=cull_14, Tolerance=0.01)  # disabled
pull_6 = PullPoint(Point=end_3.End, Geometry=crv_9, ClosestOnly=True)  # -> ClosestPoint, Distance; disabled
pull_7 = PullPoint(Point=end_3.Start, Geometry=crv_9, ClosestOnly=True)  # -> ClosestPoint, Distance; disabled
random_4 = Random(Range=Domain(0, 1), Number=lng_6, Seed=2)  # disabled
dedomain = DeconstructDomain(Domain=bnd_11)  # -> Start, End; disabled
len_3 = Length(Curve=cull_14)  # disabled
pdecon_8 = Deconstruct(Point=pull_6.ClosestPoint)  # -> XComponent, YComponent, ZComponent; disabled
pdecon_9 = Deconstruct(Point=end_3.Start)  # -> XComponent, YComponent, ZComponent; disabled
graph_3 = GraphMapper(
    random_4,
    x0=0,
    x1=1,
    y0=0,
    y1=1,
    container_name="Bezier",
    cpx=[0, 0.5113636255, 0.625, 1],
    cpy=[0, 0.2840909362, 0.75, 1])  # disabled
gradient = Gradient(
    LowerLimit=dedomain.Start,
    UpperLimit=dedomain.End,
    Parameter=pdecon_6.ZComponent,
    stops=[0: RGB(255, 119, 92), 0.242: RGB(255, 191, 117), 0.565: RGB(255, 247, 133), 0.763: RGB(172, 250, 223), 1: RGB(92, 182, 184)])  # disabled
pt_6 = ConstructPoint(XCoordinate=pdecon_8.XComponent, YCoordinate=pdecon_8.YComponent, ZCoordinate=pull_6.Distance)  # disabled
pt_7 = ConstructPoint(XCoordinate=pdecon_9.XComponent, YCoordinate=pdecon_9.YComponent, ZCoordinate=pull_7.Distance)  # disabled
remap_12 = RemapNumbers(Value=graph_3, Source=Domain(0, 1), Target=bnd_10)  # -> Mapped, Clipped; disabled
larger_4 = LargerThan(FirstNumber=pdecon_7.ZComponent, SecondNumber=remap_12.Mapped)  # -> LargerThan, OrEqualTo; disabled
ln_3 = Line(StartPoint=pt_7, EndPoint=pt_6)  # disabled
preview_9 = CustomPreview(Geometry=orient.Geometry, Material=gradient)  # disabled
dispatch_7 = Dispatch(List=orient.Geometry, DispatchPattern=larger_4.LargerThan)  # -> ListA, ListB; disabled
jitter_5 = Jitter(List=dispatch_7.ListB, Jitter=1, Seed=2)  # -> Values, Indices; disabled
jitter_6 = Jitter(List=dispatch_7.ListA, Jitter=1, Seed=2)  # -> Values, Indices; disabled
dispatch_8 = Dispatch(List=jitter_6.Values, DispatchPattern=[True, False])  # -> ListA, ListB; disabled
dispatch_9 = Dispatch(List=jitter_5.Values, DispatchPattern=[True, False])  # -> ListA, ListB; disabled
swatch_9 = ColourSwatch(SwatchColor=RGB(255, 236, 143))  # disabled
swatch_10 = ColourSwatch(SwatchColor=RGB(143, 255, 186))  # disabled
swatch_11 = ColourSwatch(SwatchColor=RGB(255, 174, 43))  # disabled
swatch_12 = ColourSwatch(SwatchColor=RGB(43, 255, 188))  # disabled
preview_10 = CustomPreview(Geometry=dispatch_8.ListA, Material=swatch_9)  # disabled
preview_11 = CustomPreview(Geometry=dispatch_9.ListA, Material=swatch_10)  # disabled
preview_12 = CustomPreview(Geometry=dispatch_8.ListB, Material=swatch_11)  # disabled
preview_13 = CustomPreview(Geometry=dispatch_9.ListB, Material=swatch_12)  # disabled
