# Grasshopper definition sesion-8-ladybug-galapagos.gh (Grasshopper 1.0.7)
# plug-ins: Bifocals

genes = GenePool(Decimals=2, Maximum=1, Minimum=0, Value=[0.35, 0.45])  # disabled
rec = Rectangle({Plane=PlaneXY(475.2292223, 19.528954, 0), Size=Domain2(u=-46.86278474..46.86278474, v=-42.16709704..42.16709704)})  # disabled

rec_2 = Rectangle({Plane=PlaneXY(475.2292223, 19.528954, 0), Size=Domain2(u=-46.86278474..46.86278474, v=-42.16709704..42.16709704)})  # disabled

item = ListItem(List=genes, Index=0, Wrap=True)  # -> Item, Item1; disabled
number_slider = Slider(0.1, range=0..1)  # disabled
genes_2 = GenePool(
    Decimals=2,
    Maximum=1,
    Minimum=0,
    Value=[0.74, 0.22, 0.42, 0.41, 0.2, 0.28, 0.98, 0.89, 0.02, 0.01, 0.73, 0.85, 0.06, 0.49, 0.08, 0.68, 0.5, 0.92, 0.99, 0.02])  # disabled
genes_3 = GenePool(
    Decimals=2,
    Maximum=1,
    Minimum=0,
    Value=[0.77, 0.71, 0.26, 0.53, 0.36, 0.63, 0.71, 0.07, 0.61, 0.95, 0.43, 0.68, 0.02, 0.72, 0.65, 0.27, 0.71, 0.84, 0.03, 0.93])  # disabled
number_slider_2 = Slider(1, range=0..1)  # disabled
panel = Panel("{")  # disabled
panel_2 = Panel(",")  # disabled
panel_3 = Panel("0")  # disabled
panel_4 = Panel("}")  # disabled
concat = Concatenate(
    FragmentA=panel,
    FragmentB=item.Item,
    FragmentC=panel_2,
    FragmentD=item.Item1,
    FragmentF=panel_2,
    FragmentG=panel_3,
    FragmentE=panel_4)  # disabled
srf = Surface(<surface referenced from the Rhino model>)  # disabled
rec_3 = Rectangle({Plane=PlaneXY(475.2292223, 19.528954, 0), Size=Domain2(u=-46.86278474..46.86278474, v=-42.16709704..42.16709704)})  # disabled
expression = Expression(x=genes_3, y=genes_2, Expression="{x,y,0}")  # disabled
number_slider_3 = Slider(13, range=0..25)  # disabled
pt = ConstructPoint(XCoordinate=number_slider, YCoordinate=number_slider_2, ZCoordinate=0)  # disabled
number_slider_4 = Slider(19, range=0..25)  # disabled
evalsrf = EvaluateSurface(Surface=reparameterize(rec), Point=concat)  # -> Point, Normal, UDirection, VDirection, Frame; disabled
srf_2 = Surface(reparameterize(rec_3))  # disabled
pln = Plane(evalsrf.Point)  # disabled
evalsrf_2 = EvaluateSurface(Surface=reparameterize(srf), Point=pt)  # -> Point, Normal, UDirection, VDirection, Frame; disabled
number_slider_5 = Slider(156, range=0..180)  # disabled
evalsrf_3 = EvaluateSurface(Surface=srf_2, Point=expression)  # -> Point, Normal, UDirection, VDirection, Frame; disabled
xy = XYPlane(Origin=pln)  # disabled
pdecon = Deconstruct(Point=evalsrf_2.Point)  # -> XComponent, YComponent, ZComponent; disabled
neg = Negative(Value=number_slider_4)  # disabled
neg_2 = Negative(Value=number_slider_3)  # disabled
geo = Geometry(flatten([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]))  # disabled
hull = ConvexHull(Points=evalsrf_3.Point, Plane=PlaneXY(0, 0, 0))  # -> Hull, HullZ, Indices; disabled
galapagos = Galapagos(fitness=pdecon, gene=[number_slider_2, number_slider])
panel_5 = Panel(pdecon.ZComponent)  # disabled
dom = ConstructDomain(DomainStart=number_slider_4, DomainEnd=neg)  # disabled
dom_2 = ConstructDomain(DomainStart=number_slider_3, DomainEnd=neg_2)  # disabled
rotate = Rotate(Geometry=pln, Angle=degrees(number_slider_5), Plane=xy)  # -> Geometry, Transform; disabled
area = Area(Geometry=hull.Hull)  # -> Area, Centroid; disabled
colom = CollisionOneMany(Collider=hull.Hull, Obstacles=geo)  # -> Collision, Index; disabled
rectangle = Rectangle(Plane=rotate.Geometry, XSize=dom, YSize=dom_2, Radius=0)  # -> Rectangle, Length; disabled
geo_2 = Geometry(flatten([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]))  # disabled
expression_2 = Expression(x=area.Area, y=colom.Collision, Expression="If (y= true,x/500,x)")  # disabled

geo_3 = Geometry(flatten([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]))  # disabled

genes_4 = GenePool(Decimals=2, Maximum=1, Minimum=0, Value=[0.39, 0.48])  # disabled
item_2 = ListItem(List=genes_4, Index=0, Wrap=True)  # -> Item, Item1; disabled
panel_6 = Panel("{")  # disabled
panel_7 = Panel(",")  # disabled
panel_8 = Panel("0")  # disabled
panel_9 = Panel("}")  # disabled
concat_2 = Concatenate(
    FragmentA=panel_6,
    FragmentB=item_2.Item,
    FragmentC=panel_7,
    FragmentD=item_2.Item1,
    FragmentF=panel_7,
    FragmentG=panel_8,
    FragmentE=panel_9)  # disabled
number_slider_6 = Slider(17, range=0..25)  # disabled
number_slider_7 = Slider(25, range=0..25)  # disabled
evalsrf_4 = EvaluateSurface(Surface=reparameterize(rec_2), Point=concat_2)  # -> Point, Normal, UDirection, VDirection, Frame; disabled
pln_2 = Plane(evalsrf_4.Point)  # disabled
number_slider_8 = Slider(155, range=0..180)  # disabled
xy_2 = XYPlane(Origin=pln_2)  # disabled
neg_3 = Negative(Value=number_slider_7)  # disabled
neg_4 = Negative(Value=number_slider_6)  # disabled
dom_3 = ConstructDomain(DomainStart=number_slider_7, DomainEnd=neg_3)  # disabled
dom_4 = ConstructDomain(DomainStart=number_slider_6, DomainEnd=neg_4)  # disabled
rotate_2 = Rotate(Geometry=pln_2, Angle=degrees(number_slider_8), Plane=xy_2)  # -> Geometry, Transform; disabled
rectangle_2 = Rectangle(Plane=rotate_2.Geometry, XSize=dom_3, YSize=dom_4, Radius=0)  # -> Rectangle, Length; disabled
area_2 = Area(Geometry=rectangle_2.Rectangle)  # -> Area, Centroid; disabled
project = Project(Geometry=rectangle_2.Rectangle, Plane=PlaneXY(0, 0, 0))  # -> Geometry, Transform; disabled
project_2 = Project(Geometry=geo_3, Plane=PlaneXY(0, 0, 0))  # -> Geometry, Transform; disabled
colom_2 = CollisionOneMany(Collider=project.Geometry, Obstacles=project_2.Geometry)  # -> Collision, Index; disabled
expression_3 = Expression(x=area_2.Area, y=colom_2.Collision, Expression="If (y = true , x/1000, x)")  # disabled
galapagos_2 = Galapagos(fitness=expression_3, gene=[number_slider_7, number_slider_6, number_slider_8, genes_4])

area_3 = Area(Geometry=rectangle.Rectangle)  # -> Area, Centroid; disabled
project_3 = Project(Geometry=rectangle.Rectangle, Plane=PlaneXY(0, 0, 0))  # -> Geometry, Transform; disabled
project_4 = Project(Geometry=geo_2, Plane=PlaneXY(0, 0, 0))  # -> Geometry, Transform; disabled
colom_3 = CollisionOneMany(Collider=project_3.Geometry, Obstacles=project_4.Geometry)  # -> Collision, Index; disabled
galapagos_3 = Galapagos(fitness=expression_2, gene=[genes_3, genes_2])
panel_10 = Panel(expression_2)
expression_4 = Expression(x=area_3.Area, y=colom_3.Collision, Expression="If (y = true , x/1000, x)")  # disabled
galapagos_4 = Galapagos()
rec_4 = Rectangle({Plane=PlaneXY(474.4712169, 14.81734249, 0), Size=Domain2(u=-49.32878759..49.32878759, v=-33.71937093..33.71937093)})
genes_5 = GenePool(
    Decimals=2,
    Maximum=1,
    Minimum=0,
    Value=[0.0322299516, 0.559038549, 0.2903785102, 0.152823493, 0.1511098012, 0.5, 0.5, 0.5, 0.5, 0.5])
genes_6 = GenePool(
    Decimals=2,
    Maximum=1,
    Minimum=0,
    Value=[0.5927453808, 0.9804806211, 0.3927674696, 0.01096412028, 0.05500727894, 0.5, 0.5, 0.5, 0.5, 0.5])
srf_3 = Surface(rec_4)
srf_4 = Surface(reparameterize(srf_3))
pt_2 = ConstructPoint(XCoordinate=genes_6, YCoordinate=genes_5, ZCoordinate=0)
divide = DivideDomain²(Domain=srf_4, UCount=Slider(5, range=0..10), VCount=Slider(2, range=0..10))
subsrf = Isotrim(Surface=srf_4, Domain=divide)
evalsrf_5 = EvaluateSurface(Surface=reparameterize(subsrf), Point=pt_2)  # -> Point, Normal, UDirection, VDirection, Frame
geo_4 = Geometry(flatten([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]))
hull_2 = ConvexHull(Points=evalsrf_5.Point, Plane=PlaneXY(0, 0, 0))  # -> Hull, HullZ, Indices
area_4 = Area(Geometry=hull_2.Hull)  # -> Area, Centroid
colom_4 = CollisionOneMany(Collider=hull_2.Hull, Obstacles=geo_4)  # -> Collision, Index
expression_5 = Expression(x=area_4.Area, y=colom_4.Collision, Expression="If ( y = true , x/500 , x)")
galapagos_5 = Galapagos(fitness=expression_5, gene=[genes_6, genes_5])
panel_11 = Panel(expression_5)
ladybug = Ladybug_Ladybug()  # -> Vviiiiiiiiiizzz; disabled; plug-in component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
genes_7 = GenePool(Decimals=2, Maximum=1, Minimum=0, Value=[1, 0.01, 0.79, 0.1, 0.81])  # disabled
genes_8 = GenePool(Decimals=2, Maximum=1, Minimum=0, Value=[0.27, 0.76, 0.61, 0.36, 0.45])  # disabled
expression_6 = Expression(x=genes_7, y=genes_8, Expression="{x,y,0}")  # disabled
rec_5 = Rectangle({Plane=PlaneXY(475.2292223, 19.528954, 0), Size=Domain2(u=-46.86278474..46.86278474, v=-42.16709704..42.16709704)})  # disabled
srf_5 = Surface(reparameterize(rec_5))  # disabled
evalsrf_6 = EvaluateSurface(Surface=srf_5, Point=expression_6)  # -> Point, Normal, UDirection, VDirection, Frame; disabled
geo_5 = Geometry(flatten([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]))  # disabled
hull_3 = ConvexHull(Points=evalsrf_6.Point, Plane=PlaneXY(0, 0, 0))  # -> Hull, HullZ, Indices; disabled
area_5 = Area(Geometry=hull_3.Hull)  # -> Area, Centroid; disabled
colom_5 = CollisionOneMany(Collider=hull_3.Hull, Obstacles=geo_5)  # -> Collision, Index; disabled
galapagos_6 = Galapagos(fitness=expression_7, gene=[genes_7, genes_8])
panel_12 = Panel("https://www.energyplus.net/weather-download/north_and_central_america_wmo_region_4/USA/TN/USA_TN_Nashville.Intl.AP.723270_TMY3/all")  # disabled
expression_7 = Expression(x=area_5.Area, y=colom_5.Collision, Expression="If (y= true,x/500,x)")  # disabled
ladybug_2 = Ladybug_Ladybug()  # -> Vviiiiiiiiiizzz; disabled; plug-in component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
panel_13 = Panel(ladybug_2)  # disabled
geo_6 = Geometry(flatten([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]))  # disabled
epw_stat = Ladybug_OpenEPWAndSTATWeatherFiles(weatherFileURL=panel_12)  # -> epwFile, statFile; disabled; plug-in component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
panel_14 = Panel(epw_stat.epwFile)  # disabled
number_slider_9 = Slider(8, range=0..10)  # disabled
crv = Curve(hull_3.Hull)  # disabled
panel_15 = Panel("16 to 30")  # disabled
lng = ListLength(List=geo_6)  # disabled
explode = Explode(Curve=crv, Recursive=True)  # -> Segments, Vertices; disabled
toggle = BooleanToggle(True)  # disabled
genes_9 = GenePool(Decimals=2, Maximum=15, Minimum=7, Value=[15, 9.91, 9.22, 15, 15])  # disabled
panel_16 = Panel("0")  # disabled
path = FilePath("C:\Users\test\Desktop\ESP_Madrid.082210_IWEC.epw")  # disabled
random = Random(Range=panel_15, Number=lng, Seed=2)  # disabled
cull_i = CullIndex(List=reverse(explode.Vertices), Indices=panel_16, Wrap=True)  # -> reverse(List); disabled
neg_5 = Negative(Value=number_slider_9)  # disabled
Z = UnitZ(Factor=random)  # disabled
offset = OffsetCurve(Curve=crv, Distance=neg_5, Plane=PlaneXY(0, 0, 0), Corners=1)  # disabled
gencumulativeskymtx = Ladybug_GenCumulativeSkyMtx(epwFile=path, skyDensity=0, useOldRes=True, runIt=toggle)  # -> readMe, cumulativeSkyMtx; disabled; plug-in component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
index = ItemIndex(List=cull_i, Item=cull_i)  # disabled
extr = Extrude(Base=geo_6, Direction=Z)  # disabled
number_slider_10 = Slider(21, range=0..100)  # disabled
number_slider_11 = Slider(8, range=0..10)  # disabled
crv_2 = Curve(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)  # disabled
item_3 = ListItem(List=genes_9, Index=index, Wrap=True)  # disabled
cap = CapHoles(Brep=extr)  # disabled
explode_2 = Explode(Curve=crv_2, Recursive=True)  # -> Segments, Vertices; disabled
genes_10 = GenePool(Decimals=2, Maximum=15, Minimum=7, Value=[15, 12.88, 9.12, 12.92, 12.63])  # disabled
panel_17 = Panel("0")  # disabled
Z_2 = UnitZ(Factor=item_3)  # disabled
cull_i_2 = CullIndex(List=reverse(explode_2.Vertices), Indices=panel_17, Wrap=True)  # -> reverse(List); disabled
srf_6 = Surface(offset)  # disabled
neg_6 = Negative(Value=number_slider_11)  # disabled
move = Move(Geometry=cull_i, Motion=Z_2)  # -> Geometry, Transform; disabled
Z_3 = UnitZ(Factor=number_slider_10)  # disabled
selectskymtx = Ladybug_selectSkyMtx(cumulativeSkyMtx=gencumulativeskymtx.cumulativeSkyMtx, removeDiffuse=False, removeDirect=False)  # -> readMe, selectedSkyMtx; disabled; plug-in component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
toggle_2 = BooleanToggle(True)  # disabled
brep = Brep(cap)  # disabled

number_slider_12 = Slider(2.1, range=0..10)  # disabled
wires = BrepWireframe(Brep=brep, Density=-1)  # disabled
swatch = ColourSwatch(SwatchColor=RGB(0, 0, 0))  # disabled
ext = ExtendCurve(Curve=wires, Type=0, Start=number_slider_12, End=number_slider_12)  # disabled
preview = CustomPreview(Geometry=ext, Shader=swatch)  # disabled

offset_2 = OffsetCurve(Curve=crv_2, Distance=neg_6, Plane=PlaneXY(0, 0, 0), Corners=1)  # disabled
index_2 = ItemIndex(List=cull_i_2, Item=cull_i_2)  # disabled
geo_7 = Geometry(flatten([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]))  # disabled
extr_2 = Extrude(Base=srf_6, Direction=Z_3)  # disabled
number_slider_13 = Slider(21, range=0..100)  # disabled
item_4 = ListItem(List=genes_10, Index=index_2, Wrap=True)  # disabled
pline = PolyLine(Vertices=move.Geometry, Closed=toggle_2)  # disabled
panel_18 = Panel("16 to 30")  # disabled
lng_2 = ListLength(List=geo_7)  # disabled
Z_4 = UnitZ(Factor=item_4)  # disabled
srf_7 = Surface(crv)  # disabled
fpatch = FragmentPatch(Boundary=pline)  # disabled
rulesrf = RuledSurface(CurveA=crv, CurveB=pline)  # disabled
random_2 = Random(Range=panel_18, Number=lng_2, Seed=2)  # disabled
srf_8 = Surface(offset_2)  # disabled
move_2 = Move(Geometry=cull_i_2, Motion=Z_4)  # -> Geometry, Transform; disabled
Z_5 = UnitZ(Factor=number_slider_13)  # disabled
Z_6 = UnitZ(Factor=random_2)  # disabled
toggle_3 = BooleanToggle(True)  # disabled
panel_19 = Panel("4")  # disabled
join = BrepJoin(Breps=flatten([srf_7, rulesrf, fpatch]))  # -> Breps, Closed; disabled
panel_20 = Panel(".01")  # disabled
toggle_4 = BooleanToggle(True)  # disabled
extr_3 = Extrude(Base=geo_7, Direction=Z_6)  # disabled
extr_4 = Extrude(Base=srf_8, Direction=Z_5)  # disabled
sdiff = SolidDifference(BrepsA=join.Breps, BrepsB=extr_2)  # disabled
toggle_5 = BooleanToggle(True)  # disabled
pline_2 = PolyLine(Vertices=move_2.Geometry, Closed=toggle_3)  # disabled
cap_2 = CapHoles(Brep=extr_3)  # disabled
path_2 = FilePath("C:\Users\test\Desktop\ESP_Madrid.082210_IWEC.epw")  # disabled
srf_9 = Surface(crv_2)  # disabled
gencumulativeskymtx_2 = Ladybug_GenCumulativeSkyMtx(epwFile=path_2, skyDensity=0, useOldRes=True, runIt=toggle_5)  # -> readMe, cumulativeSkyMtx; disabled; plug-in component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
fpatch_2 = FragmentPatch(Boundary=pline_2)  # disabled
rulesrf_2 = RuledSurface(CurveA=crv_2, CurveB=pline_2)  # disabled
join_2 = BrepJoin(Breps=flatten([srf_9, rulesrf_2, fpatch_2]))  # -> Breps, Closed; disabled
brep_2 = Brep(cap_2)  # disabled
number_slider_14 = Slider(2.1, range=0..10)  # disabled
sdiff_2 = SolidDifference(BrepsA=join_2.Breps, BrepsB=extr_4)  # disabled

# ---- group: test geometry
brep_3 = Brep(sdiff_2)  # disabled

# ----
radiationanalysis = Ladybug_RadiationAnalysis(
    geometry=flatten(brep_3),
    context=flatten(brep),
    gridSize=panel_19,
    disFromBase=panel_20,
    selectedSkyMtx=flatten(selectskymtx.selectedSkyMtx),
    parallel=toggle_4,
    runIt=toggle_4)  # -> readMe, contextMesh, analysisMesh, testPts, testVec, port, radiationResult, radiationMesh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; disabled; plug-in component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
selectskymtx_2 = Ladybug_selectSkyMtx(cumulativeSkyMtx=gencumulativeskymtx_2.cumulativeSkyMtx, removeDiffuse=False, removeDirect=False)  # -> readMe, selectedSkyMtx; disabled; plug-in component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
wires_2 = BrepWireframe(Brep=brep_2, Density=-1)  # disabled
number_slider_15 = Slider(1, range=0..10)  # disabled
mesh = Mesh(radiationanalysis.analysisMesh)  # disabled
ma = MassAddition(Input=flatten(radiationanalysis.radiationResult))  # -> Result, PartialResults; disabled
srfsplit = SurfaceSplit()  # disabled
swatch_2 = ColourSwatch(SwatchColor=RGB(0, 0, 0))  # disabled
trim = TrimSolid()  # disabled
ext_2 = ExtendCurve(Curve=wires_2, Type=0, Start=number_slider_14, End=number_slider_14)  # disabled
brep_4 = Brep(sdiff)  # disabled
item_5 = ListItem(List=mesh, Index=number_slider_15, Wrap=True)  # disabled
item_6 = ListItem(List=radiationanalysis.radiationResult, Index=number_slider_15, Wrap=True)  # disabled
preview_2 = CustomPreview(Geometry=ext_2, Shader=swatch_2)  # disabled
toggle_6 = BooleanToggle(True)
radiationanalysis_2 = Ladybug_RadiationAnalysis(
    geometry=flatten(brep_4),
    context=flatten(brep_2),
    gridSize="5",
    disFromBase=".01",
    selectedSkyMtx=flatten(selectskymtx_2.selectedSkyMtx),
    parallel=toggle_6,
    runIt=toggle_6)  # -> readMe, contextMesh, analysisMesh, testPts, testVec, port, radiationResult, radiationMesh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; plug-in component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
panel_21 = Panel(expression_7)  # disabled
number_slider_16 = Slider(2400, range=0..10000)  # disabled
division = Division(A=radiationanalysis_2.totalRadiation, B=number_slider_16)  # disabled
galapagos_7 = Galapagos(fitness=division, gene=genes_9)
panel_22 = Panel(division)  # disabled
